# Grasshopper definition Wall_StressLines.gh (Grasshopper 1.0.7)
# plug-ins: karambaGH

length = Slider(14, range=0.5..15)
height = Slider(3.5, range=0.5..3.5)
X = Slider(10.9, range=0.5..15)
Y = Slider(1.3, range=0.5..3.5)
R = Slider(1, range=0..1)
R_2 = Slider(0.3, range=0..1)
X_2 = Slider(6.4, range=0.5..15)
Y_2 = Slider(2, range=0.5..3.5)
R_3 = Slider(0.5, range=0..1)
R_4 = Slider(1, range=0..1)
X_3 = Slider(2.9, range=0.5..15)
Y_3 = Slider(1.4, range=0.5..3.5)
R_5 = Slider(1, range=0..1)
pt = ConstructPoint(XCoordinate=0, YCoordinate=0, ZCoordinate=0)
pt_2 = ConstructPoint(XCoordinate=length, YCoordinate=0, ZCoordinate=0)
pt_3 = ConstructPoint(XCoordinate=0, YCoordinate=height, ZCoordinate=0)
pt_4 = ConstructPoint(XCoordinate=length, YCoordinate=height, ZCoordinate=0)
pt_5 = ConstructPoint(XCoordinate=X_3, YCoordinate=Y_3, ZCoordinate=0)
pt_6 = ConstructPoint(XCoordinate=X_2, YCoordinate=Y_2, ZCoordinate=0)
pt_7 = ConstructPoint(XCoordinate=X, YCoordinate=Y, ZCoordinate=0)
srf4pt = _4PointSurface(CornerA=pt, CornerB=pt_2, CornerC=pt_4, CornerD=pt_3)
cir = Circle(Plane=pt_5, Radius=R_5)
ellipse = Ellipse(Plane=pt_6, Radius1=R_3, Radius2=R_4)  # -> Ellipse, Focus1, Focus2
polygon = Polygon(Plane=pt_7, Radius=R, Segments=Slider(3, range=0..10), FilletRadius=R_2)  # -> Polygon, Length
split = SplitBrep(Brep=srf4pt, Cutter=cir)
item = ListItem(List=split, Index=1, Wrap=True)
split_2 = SplitBrep(Brep=item, Cutter=ellipse.Ellipse)
item_2 = ListItem(List=split_2, Index=1, Wrap=True)
split_3 = SplitBrep(Brep=item_2, Cutter=polygon.Polygon)
item_3 = ListItem(List=split_3, Index=1, Wrap=True)
custom_mesh_settings = SettingsCustom(
    StitchSeams=True,
    SimplePlanes=False,
    Refine=False,
    MinCount=100,
    MaxCount=400,
    AspectRatio=1,
    MaxDistance=0,
    MaxAngle=20,
    MinEdge=0.1,
    MaxEdge=2)
mesh = MeshBrep(Brep=item_3, Settings=custom_mesh_settings)
preview = CustomPreview(
    Geometry=item_3,
    Material={diffuse=RGB(192, 192, 192), emission=RGB(128, 128, 128), shine=0.5, specular=RGB(255, 255, 255), transparency=0})
meshtoshell = MeshToShellKaramba3D(Mesh=mesh, LimitDistance_m=0.005)  # -> Element, Points, Info
pdecon = Deconstruct(Point=meshtoshell.Points)  # -> XComponent, YComponent, ZComponent
sort = SortList(Keys=pdecon.YComponent, ValuesA=meshtoshell.Points)  # -> Keys, ValuesA
equals = Equality(FirstNumber=sort.Keys, SecondNumber=0)  # -> Equality, Inequality
Y_4 = UnitY(Factor=1)
dispatch = Dispatch(List=sort.ValuesA, DispatchPattern=equals.Equality)  # -> ListA, ListB
python = GhPythonScript()  # -> Out, A
loads = LoadsKaramba3D(Vector=Y_4, LCase=0, mode="Gravity")
supp = SupportKaramba3D(PosInd=dispatch.ListA, menu=[buttons(on, on, on, on, on, on)])
assemble = AssembleModelKaramba3D(Elem=meshtoshell.Element, Support=flatten(supp), Load=loads, LimitDistance_m=0.005)  # -> Model, Info, Mass_kg, CenterOfGravity
analyze = AnalyzeKaramba3D(Model=assemble.Model)  # -> CalculatedModel, MaximumDisplacement_cm, ResultingForceOfGravity_kN, ElasticEnergy_kNm
shellview = ShellViewKaramba3D(Model=analyze.CalculatedModel, IndexOfLayer=0)  # -> Model, MeshesOfRenderedShells, LegendColors, LegendTags
shelllineresults = LineResultsOnShellsKaramba3D(
    AnalyzedModel=analyze.CalculatedModel,
    LayerPosition=0,
    ListOfSourcesOfPrincipalStressLinesLinesPoints=meshtoshell.Points,
    SegmentLength_m=0.5,
    DA_deg=5,
    mode="PrincStress")  # -> AnalyzedModel, Lines1, Lines2
preview_2 = CustomPreview(
    Geometry=shelllineresults.Lines2,
    Material={diffuse=RGB(255, 0, 0), emission=RGB(255, 0, 0), shine=0.5, specular=RGB(255, 255, 255), transparency=0})
preview_3 = CustomPreview(
    Geometry=shelllineresults.Lines1,
    Material={diffuse=RGB(0, 0, 255), emission=RGB(0, 0, 255), shine=0.5, specular=RGB(255, 255, 255), transparency=0})
