# Grasshopper definition window_in_wall.ghx (Grasshopper 1.0.7)

reload = Button()
py = PythonScript(reload=reload)
# ---------- py: Python ----------
from compas_rhino.utilities.misc import get_tolerance
from compas_rhino.utilities.misc import unload_modules

from compas_ghpython import unload_modules

unload_modules("compas")
unload_modules("compas_fab")
unload_modules("ur_fabrication_control")
unload_modules("assembly_information_model")
unload_modules("am_information_model") 
unload_modules("window_in_wall")
# ---------- end py ----------
py_2 = PythonScript()  # -> HERE, DATA
# ---------- py_2: Python ----------
import os

HERE = os.path.dirname(ghdoc.Path)
DATA = os.path.abspath(os.path.join(HERE, "..", "data"))

#print(HERE)
#print(DATA)
# ---------- end py_2 ----------

gate_size = Number(0.84)
gate_x = Number(2.24)

height = Number(3.3)
elsize = Number(0.084)
width = Number(4.5)
create_wall = GhPythonScript(init=Button(), width=width, height=height, elsize=elsize)  # -> wall
# ---------- create_wall: Python ----------
from window_in_wall import Wall


# create wall
wall = Wall()


# construct COMPAS quad mesh from width and height
wall.create_quad_mesh_from_dimensions(width, height, elsize)
# ---------- end create_wall ----------

list = ValueList({"circular", "persian"}, selected="persian")
toggle = BooleanToggle(True)
make_gate = GhPythonScript(wall=create_wall, make_gate=toggle, gate_type=list, gate_x=gate_x, gate_size=gate_size)  # -> out, wall
# ---------- make_gate: Python ----------
if make_gate:
    wall.make_gate(gate_size, gate_x, gate_type)
# ---------- end make_gate ----------
displacement = GhPythonScript(wall=make_gate.wall, comp_displ=toggle)  # -> out, wall
# ---------- displacement: Python ----------
from compas.rpc import Proxy

if comp_displ:
    #wall_methods_numpy = Proxy('window_in_wall.wall_methods_numpy')
    wall_methods_pde = Proxy('window_in_wall.wall_methods_pde')
    #wall_methods_numpy.stop_server() #if changes need to be reloaded
    #wall_methods_numpy.start_server()
    
    # compute displacement
    #solX, solZ = wall_methods_numpy.compute_displacement(wall.mesh,wall.gate_points, wall.x_size, wall.z_size)
    solX = wall_methods_pde.compute_displacement_x(wall.mesh,wall.gate_points, wall.x_size, wall.z_size)
    solZ = wall_methods_pde.compute_displacement_z(wall.mesh,wall.gate_points, wall.x_size, wall.z_size)
    
    # update vertex attributes with displacement values
    for v, data in wall.mesh.vertices(data=True):        
        wall.mesh.vertex_attribute(v, "x_disp", value=solX[v]) #value=solX[n_from_ij(i,j, wall.z_size)]
        wall.mesh.vertex_attribute(v, "z_disp", value=solZ[v]) #value=solZ[n_from_ij(i,j, wall.z_size)]
    
    # displace the vertices (for preview only)
    # wall.displace_vertices()
    #solmat = np.reshape(solX, (-1, n))
# ---------- end displacement ----------

up_phase = Slider(0.912, range=0..3)
up_freq = Slider(2.389, range=1..3)
up_amp = Slider(0.039, range=0..0.1)
down_phase = Slider(1.023, range=0..3)
down_freq = Slider(1.824, range=1..3)
down_amp = Slider(0.028, range=0..0.1)
wave = GhPythonScript(
    wall=displacement.wall,
    wave=Toggle(True),
    up_amp=up_amp,
    up_freq=up_freq,
    up_phase=up_phase,
    down_amp=down_amp,
    down_freq=down_freq,
    down_phase=down_phase)  # -> out, wall; inputs wave: Boolean
# ---------- wave: Python ----------
if wave:
    #wall.undulate(amp, freq, phase)
    #wall.undulate(up_amp, up_freq, up_phase, down_amp, down_freq, down_phase)
    wall.undulate_with_displ(up_amp, up_freq, up_phase, down_amp, down_freq, down_phase)
    #wall.undulate_with_displ(amp, freq, phase)
# ---------- end wave ----------

visualize = GhPythonScript(wall=wave.wall)  # -> out, rhmesh, vertices, points, x_disp, z_disp
# ---------- visualize: Python ----------
from compas_ghpython.artists import MeshArtist

# Mesh Artist for visualization
artist = MeshArtist(wall.mesh)
#vertices = artist.draw_vertices()
#edges = artist.draw_edges()
#faces = artist.draw_faces()
#labels = {key: key for key in mesh.vertices()}

rhmesh = artist.draw()


# draw gate points
v = []
for vertex in wall.mesh.vertices():
    gp = wall.mesh.vertex_attribute(vertex, name='in_gate')
    if gp: v.append(vertex)

if len(v): vertices = artist.draw_vertices(vertices=v)

x_disp = []
z_disp = []
for vertex in wall.mesh.vertices():
    x_disp.append(wall.mesh.vertex_attribute(vertex, name='x_disp'))
    z_disp.append(wall.mesh.vertex_attribute(vertex, name='z_disp'))
    

p = []
for vertex in wall.mesh.vertices():
    if gp: v.append(vertex)

if len(v): points = artist.draw_vertices(vertices=p)
# ---------- end visualize ----------
mesh = Mesh(visualize.rhmesh)
pt = Point(visualize.vertices)
preview = CustomPreview(Geometry=mesh, Material=ColourSwatch(SwatchColor=RGB(255, 125, 125)))
preview_2 = CustomPreview(Geometry=pt, Material=ColourSwatch(SwatchColor=RGB(255, 184, 184)))

pt_2 = Point(visualize.points)

# ---- group: vector field
vector_size = Slider(0.219, range=0..0.5)
vec = VectorXYZ(XComponent=visualize.x_disp, YComponent=0, ZComponent=visualize.z_disp)  # -> Vector, Length
minus_one = Number(-1)
eps = Number(1e-07)
pow = Power(A=vector_size, B=minus_one)
avoid_zero = Addition(A=vec.Length, B=eps)
scale_to_size = Multiplication(A=avoid_zero, B=pow)
normalize = Division(A=visualize.x_disp, B=scale_to_size)
normalize_2 = Division(A=visualize.z_disp, B=scale_to_size)
vector_size_2 = Slider(0.655, range=0..1)
multiplication = Multiplication(A=vec.Vector, B=vector_size_2)
disp_vector = VectorXYZ(XComponent=normalize, YComponent=0, ZComponent=normalize_2)  # -> Vector, Length
scaled_vecs = VectorDisplay(Anchor=pt_2, Vector=multiplication)
equi_sized_vecs = VectorDisplay(Anchor=pt_2, Vector=disp_vector.Vector)
