# Grasshopper definition window_in_wall_design_doublelayer_am_model.ghx (Grasshopper 1.0.7)

crv = Curve(<curve referenced from the Rhino model>)
crv_2 = Curve(<curve referenced from the Rhino model>)
crv_3 = Curve(<curve referenced from the Rhino model>)
crv_4 = Curve(<curve referenced from the Rhino model>)
join = JoinCurves(Curves=[crv, crv_2], Preserve=False)
join_2 = JoinCurves(Curves=[crv_3, crv_4], Preserve=False)

reload = Button()
py = PythonScript(reload=reload)
# ---------- py: Python ----------
from compas_rhino.utilities.misc import get_tolerance
from compas_rhino.utilities.misc import unload_modules

from compas_ghpython import unload_modules

unload_modules("compas")
unload_modules("compas_fab")
unload_modules("ur_fabrication_control")
unload_modules("assembly_information_model")
unload_modules("am_information_model") 
unload_modules("window_in_wall")
# ---------- end py ----------
py_2 = PythonScript()  # -> HERE, DATA
# ---------- py_2: Python ----------
import os

HERE = os.path.dirname(ghdoc.Path)
DATA = os.path.abspath(os.path.join(HERE, "..", "data"))

#print(HERE)
#print(DATA)
# ---------- end py_2 ----------

toggle = BooleanToggle(True)

# ---- group: DESIGN / Shape Initialization
list = ValueList({"circular", "persian", "interactive", "triangular"}, selected="interactive")
crv_gate_right = Curve(join)
crv_gate_left = Curve(join_2)
width = Number(5.6)
height = Number(3.6)
elsize = Number(0.05)
create_wall = GhPythonScript(init=Button(), width=width, height=height, elsize=elsize, double_layer=toggle)  # -> wall
# ---------- create_wall: Python ----------
from window_in_wall import Wall


# create wall
wall = Wall()

print len(list(wall.mesh_offset.vertices()))

# construct COMPAS quad mesh from width and height

if double_layer == True:
    wall.create_quad_meshes_from_dimensions_dl(width, height, elsize)

if double_layer == False:
    wall.create_quad_meshes_from_dimensions(width, height, elsize)

#print wall.mesh
# ---------- end create_wall ----------
define_gate = GhPythonScript(
    wall=create_wall,
    gate_type=list,
    gate_x=Slider(2.4, range=1..3),
    gate_size=Slider(1.599, range=0..2),
    gate_crv_left=crv_gate_left,
    gate_crv_right=crv_gate_right)  # -> out, wall, gate_crv_left, gate_crv_right, wall_crv_left, wall_crv_right, wall_crv_middle, wall_crv_middle_b; inputs gate_crv_left: Curve, gate_crv_right: Curve
# ---------- define_gate: Python ----------
import math
import compas
import Rhino as rh
import ghpythonlib.components as ghcomp
from compas.datastructures import Mesh

import Rhino.Geometry as rg

# Create wall curves left and right
wall_crv_left = rg.Line(rg.Point3d(0,0,0), rg.Point3d(0,0,wall.height))
wall_crv_right = rg.Line(rg.Point3d(wall.width,0,0), rg.Point3d(wall.width,0,wall.height))

# Create gate curve
gate_crv_top = ghcomp.JoinCurves(curves=[gate_crv_left, gate_crv_right], preserve=False)
gate_end_pts = ghcomp.EndPoints(curve=gate_crv_top)
gate_crv_bottom = rg.Line(gate_end_pts[0], gate_end_pts[1])
gate_crv = ghcomp.JoinCurves(curves=[gate_crv_top, gate_crv_bottom], preserve=False)

if gate_type == "interactive":
    # Create wall curve above gate
    gate_left_pts = ghcomp.EndPoints(curve=gate_crv_left)
    if gate_left_pts[0].Z > gate_left_pts[1].Z:
        gate_top_pt = gate_left_pts[0]
    else:
        gate_top_pt = gate_left_pts[1]
    gate_x = gate_top_pt.X

# Define gate
for vertex in wall.mesh.vertices():
    # get x and z coordinates from vertex
    x_val = wall.mesh.vertex_attribute(vertex, name='x')
    z_val = wall.mesh.vertex_attribute(vertex, name='z')

    # calculate distance
    gate_rel_x = gate_x-x_val
    gate_rel_z = z_val

    #in order to avoid division by zero. should be cleaned up ASAP
    if gate_rel_x==0:
        gate_rel_x=0.000000001

    #this boolean will be set to True if vertex lies inside the gate 
    in_gate_vertex = False

    #for each gate tpye, the a corresponding function is called to check
    # to check if vertex lies inside the gate
    if gate_type=="circular":
        if wall.in_gate_circular(gate_size, gate_rel_x,gate_rel_z):
            in_gate_vertex = True
    elif gate_type=="persian":
        if wall.in_gate_persian(gate_size, gate_rel_x,gate_rel_z):
            in_gate_vertex = True
    elif gate_type=="triangular":
        if wall.in_gate_triangular(gate_size, gate_rel_x,gate_rel_z):
            in_gate_vertex = True
    elif gate_type=="interactive":
        point = rh.Geometry.Point3d(wall.mesh.vertex_attribute(vertex, name='x'), 0, wall.mesh.vertex_attribute(vertex, name='z') )
        point_in_gate = ghcomp.PointInCurve(point,gate_crv).relationship
        if point_in_gate == 2 or point_in_gate == 1: 
            in_gate_vertex = True

    if in_gate_vertex:
        # store new vertex attribute with the distance to the gate center
        wall.mesh.vertex_attribute(vertex,"x_disp", value=-gate_rel_x)
        wall.mesh.vertex_attribute(vertex,"z_disp", value=gate_rel_z)
        #in_gate flag indicates that this vertex lies in the gate
        wall.mesh.vertex_attribute(vertex,"in_gate", value=True)
        wall.gate_points.append(vertex)

if gate_type=="circular":
    center_pt = rg.Point3d(gate_x,0,0)
    start_pt = rg.Point3d(gate_x-gate_size,0,0)
    middle_left_pt = rg.Point3d(gate_x-(gate_size*(math.sqrt(2)/2)),0,gate_size*(math.sqrt(2)/2))
    middle_pt = rg.Point3d(gate_x,0,gate_size)
    middle_right_pt = rg.Point3d(gate_x+(gate_size*(math.sqrt(2)/2)),0,gate_size*(math.sqrt(2)/2))
    end_pt = rg.Point3d(gate_x+gate_size,0,0)
    gate_crv_left = ghcomp.Arc3Pt(start_pt, middle_left_pt, middle_pt)[0]
    gate_crv_right = ghcomp.Arc3Pt(middle_pt, middle_right_pt, end_pt)[0]
elif gate_type=="triangular":
    start_pt = rg.Point3d(gate_x-gate_size,0,0)
    middle_pt = rg.Point3d(gate_x,0,gate_size)
    end_pt = rg.Point3d(gate_x+gate_size,0,0)
    gate_crv_left = ghcomp.Line(start_pt, middle_pt)
    gate_crv_right = ghcomp.Line(middle_pt, end_pt)
elif gate_type=="persian":
    pass
    
# Create wall curve above gate
gate_left_pts = ghcomp.EndPoints(curve=gate_crv_left)
if gate_left_pts[0].Z > gate_left_pts[1].Z:
    gate_top_pt = gate_left_pts[0]
    gate_bottom_pt = gate_left_pts[1]
else:
    gate_top_pt = gate_left_pts[1]
    gate_bottom_pt = gate_left_pts[0]
wall_crv_middle = rg.Line(gate_top_pt, rg.Point3d(gate_top_pt.X, gate_top_pt.Y, wall.height))
wall_crv_middle_b = rg.Line(gate_bottom_pt, rg.Point3d(gate_bottom_pt.X, gate_bottom_pt.Y,0))
# ---------- end define_gate ----------
crv_5 = Curve(define_gate.gate_crv_left)
crv_6 = Curve(define_gate.gate_crv_right)
crv_7 = Curve(define_gate.wall_crv_left)
crv_8 = Curve(define_gate.wall_crv_right)
crv_9 = Curve(define_gate.wall_crv_middle)
preview = CustomPreview(Geometry=[crv_5, crv_6, crv_7, crv_8, crv_9], Material=ColourSwatch(SwatchColor=RGB(0, 0, 0)))

# ----
crv_10 = Curve(crv_8)
crv_11 = Curve(crv_7)
end = EndPoints(Curve=crv_10)  # -> Start, End
midpt = CurveMiddle(Curve=crv_10)
midpt_2 = CurveMiddle(Curve=crv_11)
end_2 = EndPoints(Curve=crv_11)  # -> Start, End
curve_top_half_right = Line(StartPoint=midpt, EndPoint=end.End)
curve_bottom_left = Line(StartPoint=midpt, EndPoint=end.Start)
curve_bottom_right = Line(StartPoint=midpt_2, EndPoint=end_2.Start)
curve_top_half_left = Line(StartPoint=midpt_2, EndPoint=end_2.End)
up_amp = Slider(0.3, range=0..0.3)
flip = FlipCurve(Curve=crv_2)  # -> Curve, Flag
flip_2 = FlipCurve(Curve=crv_4)  # -> Curve, Flag
num = Number(1.8)
Z = UnitZ(Factor=num)
xy = XYPlane(Origin=Point(0, 0, 0))
move = Move(Geometry=xy, Motion=Z)  # -> Geometry, Transform
create = Button()

# ---- group: Visualise
list_2 = ValueList({"20", "50", "100", "500", "1000", "5000"}, selected="20")
back = Button()
reset = Button()
start = Button()
stop = Button()
step = Button()
full = Button()

# ---- group: Visualization
# VISUALIZATION
toggle_2 = BooleanToggle(True)

# ---- group: DESIGN / Shape Manipulation
down_freq = Slider(1.857, range=1..3)
up_phase = Slider(0.5, range=0..3)
up_amp_2 = Slider(0.3, range=0..0.3)
up_freq = Slider(1, range=1..3)
displacement = GhPythonScript(wall=define_gate.wall, compute_displ=Button())  # -> out, wall
# ---------- displacement: Python ----------
from compas.rpc import Proxy

#compute_displ = True
if compute_displ:
    #wall_methods_numpy = Proxy('window_in_wall.wall_methods_numpy')
    with Proxy('window_in_wall.wall_methods_pde') as wall_methods_pde:
        #wall_methods_numpy.stop_server() #if changes need to be reloaded
        #wall_methods_numpy.start_server()
        
        # compute displacement
        #solX, solZ = wall_methods_numpy.compute_displacement(wall.mesh,wall.gate_points, wall.x_size, wall.z_size)
        solX = wall_methods_pde.compute_displacement_x(wall.mesh, wall.gate_points, wall.x_size, wall.z_size)
        solZ = wall_methods_pde.compute_displacement_z(wall.mesh, wall.gate_points, wall.x_size, wall.z_size)
    
    # update vertex attributes with displacement values
    for v, data in wall.mesh.vertices(data=True):        
        wall.mesh.vertex_attribute(v, "x_disp", value=solX[v]) #value=solX[n_from_ij(i,j, wall.z_size)]
        wall.mesh.vertex_attribute(v, "z_disp", value=solZ[v]) #value=solZ[n_from_ij(i,j, wall.z_size)]
    
    # create a mesh copy with displaced vertices
    wall.create_mesh_displaced()
# ---------- end displacement ----------

# ----
pi = Pi(Factor=up_phase)

# ---- group: DESIGN / Shape Manipulation (continued)
wave = GhPythonScript(
    wall=displacement.wall,
    wave=Button(),
    up_amp=up_amp,
    up_freq=up_freq,
    up_phase=pi,
    down_amp=up_amp_2,
    down_freq=down_freq,
    down_phase=pi)  # -> out, wall; inputs wave: Boolean
# ---------- wave: Python ----------
if wave:
    #wall.undulate(amp, freq, phase)
    #wall.undulate(up_amp, up_freq, up_phase, down_amp, down_freq, down_phase)
    wall.undulate_with_displ(up_amp, up_freq, up_phase, down_amp, down_freq, down_phase)
    #wall.undulate_with_displ(amp, freq, phase)
# ---------- end wave ----------

# ---- group: Visualization (continued)
visualize = GhPythonScript(
    wall=wave.wall,
    show_mesh=toggle_2,
    show_mesh_disp=Toggle(False),
    show_vertices_gate=Toggle(False),
    show_vector_field=Toggle(False))  # -> out, rhmesh, rhmesh_offset, rhmesh_disp, vertices_gate, vertices_all, disp_vectors
# ---------- visualize: Python ----------
from compas_ghpython.artists import MeshArtist
import Rhino.Geometry as rg

rh_mesh = []
vertices_gate = []
vertices_all = []
disp_vectors = []


if show_mesh:
    # Mesh Artist for visualization
    artist = MeshArtist(wall.mesh)
    
    #vertices = artist.draw_vertices()
    #edges = artist.draw_edges()
    #faces = artist.draw_faces()
    #labels = {key: key for key in mesh.vertices()}
    
    rhmesh = artist.draw()
    
    artist_offset = MeshArtist(wall.mesh_offset)
    rhmesh_offset = artist_offset.draw()

if show_mesh_disp:
    artist_disp = MeshArtist(wall.mesh_displaced)
    rhmesh_disp = artist_disp.draw()

if show_vertices_gate:
    # draw gate points
    v = []
    for vertex in wall.mesh.vertices():
        gp = wall.mesh.vertex_attribute(vertex, name='in_gate')
        if gp: v.append(vertex)
    
    #print v
    if len(v): vertices_gate = artist.draw_vertices(vertices=v)


if show_vector_field:
    x_disp = []
    z_disp = []
    
    for vertex in wall.mesh.vertices():
        x_disp.append(wall.mesh.vertex_attribute(vertex, name='x_disp'))
        z_disp.append(wall.mesh.vertex_attribute(vertex, name='z_disp'))
    
    disp_vectors = [rg.Vector3d(x_disp[i], 0, z_disp[i])/5 for i in range(len(x_disp))]

    vertices_all = artist.draw_vertices()
# ---------- end visualize ----------
mesh = Mesh(visualize.rhmesh)
pt = Point(visualize.vertices_all)
pt_2 = Point(visualize.vertices_gate)
vec = Vector(visualize.disp_vectors)
vdisex = VectorDisplayEx(Point=pt, Vector=vec, Colour=ColourSwatch(SwatchColor=RGB(42, 0, 255)), Width=1)
preview_2 = CustomPreview(Geometry=pt_2, Material=ColourSwatch(SwatchColor=RGB(0, 0, 0)))

# ----
mesh_2 = Mesh(visualize.rhmesh_offset)
mesh_3 = Mesh(visualize.rhmesh_disp)

# ---- group: Visualization (continued)
preview_3 = CustomPreview(Geometry=[mesh, mesh_2, mesh_3], Material=ColourSwatch(SwatchColor=RGBA(255, 207, 207, 55)))

# ---- group: Fabrication
# FABRICATION
list_3 = ValueList({"1:10": 0.1, "1:5": 0.2}, selected="1:10")
div_len = GhPythonScript(scalefactor=list_3)  # -> out, max_layer_height, avg_layer_height, min_layer_height
# ---------- div_len: Python ----------
max_layer_height = 0.0065 / scalefactor
avg_layer_height = 0.0045 / scalefactor
min_layer_height = 0.0030 / scalefactor
print (avg_layer_height)
# ---------- end div_len ----------
panel = Panel("25")
panel_2 = Panel("45")
print_path_generation = GhPythonScript(
    max_layer_height=div_len.max_layer_height,
    avg_layer_height=div_len.avg_layer_height,
    min_layer_height=div_len.min_layer_height,
    angle_constraint=panel_2,
    crv_gate_left=crv_3,
    crv_gate_right=crv,
    crv_wall_left=curve_top_half_left,
    crv_wall_right=curve_top_half_right,
    crv_gate_top=define_gate.wall_crv_middle,
    crv_gate_bot=define_gate.wall_crv_middle_b,
    blend_layers=panel)  # -> out, pts_gate_left, pts_wall_left, pts_gate_right, pts_wall_right, crvs_region_left, crvs_region_right, crvs_region_left_top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; inputs crv_gate_left: Curve, crv_gate_right: Curve, crv_wall_left: Curve, crv_wall_right: Curve, crv_gate_top: Curve, blend_layers: Int32
# ---------- print_path_generation: Python ----------
import Rhino.Geometry as rg
import ghpythonlib.components as ghcomp
import math



# planes gate left
tsl = crv_gate_left.DivideByLength(avg_layer_height, True)
div_count = len(tsl)
tsc = crv_gate_left.DivideByCount(div_count, True)
planes_gate_left = [crv_gate_left.PerpendicularFrameAt(t)[1] for t in tsc]

# planes gate right
tsc = crv_gate_right.DivideByCount(len(tsl), True)
planes_gate_right = [crv_gate_right.PerpendicularFrameAt(t)[1] for t in tsc]

# planes wall left
tsl = crv_wall_left.DivideByLength(avg_layer_height, True)
planes_wall_left = [crv_wall_left.PerpendicularFrameAt(t)[1] for t in tsl]

# planes wall right
tsr = crv_wall_right.DivideByLength(avg_layer_height, True)
planes_wall_right = [crv_wall_right.PerpendicularFrameAt(t)[1] for t in tsr]

top_wall_left = rg.Curve.Split(crv_wall_left, t=tsl[len(planes_gate_left)-1])[1]
top_wall_right = rg.Curve.Split(crv_wall_right, t=tsr[len(planes_gate_right)-1])[1]

#planes_wall_left_top = planes_wall_left[len(planes_gate_left):]
#planes_wall_right_top = planes_wall_right[len(planes_gate_right):]

# planes gate top
#tsc = crv_gate_top.DivideByCount(len(planes_wall_right_top), False)
#planes_gate_top = [crv_gate_top.PerpendicularFrameAt(t)[1] for t in tsc]

tsc = crv_gate_top.DivideByLength(max_layer_height, True)
planes_gate_top = [crv_gate_top.PerpendicularFrameAt(t)[1] for t in tsc[1:]]

twl = top_wall_left.DivideByCount(len(planes_gate_top)+1, False)
twr = top_wall_right.DivideByCount(len(planes_gate_top)+1, False)
planes_wall_left_top = [top_wall_left.PerpendicularFrameAt(t)[1] for t in twl]
planes_wall_right_top = [top_wall_right.PerpendicularFrameAt(t)[1] for t in twr]


class BlendFunction():
    def __init__(self, func_type, count, blend_layers=0):
        self.count = count
        self.blend_layers = int(min(blend_layers, count/2))
        self.func_type = func_type
        self.blend_type = {
            "linear" : self.blend_linear,
            "cosine" : self.blend_cosine
        }
    
    def get_value(self, value):
        return self.blend_type[self.func_type](value)
    
    def blend_cosine(self, value):
        if self.blend_layers != 0:
            if value <= self.blend_layers:
                step = (math.pi/self.blend_layers)*value
            elif value >= self.count-self.blend_layers:
                step = math.pi + (math.pi/self.blend_layers)*(value-(self.count-self.blend_layers))
            else:
                step = math.pi
        else:
            step = (2*math.pi/self.blend_layers)*value
        blendfactor = (math.cos(math.pi+step)+1)/2
        return blendfactor

    def blend_linear(self, value):
        blendfactor = (1/self.count)*value
        return blendfactor

def generate_crvs(planes_gate, planes_wall, region="left"):
    base_tangent = rg.Vector3d(1,0,0)
    if "left" in region:
        mult=-1
    elif "right" in region:
        mult = 1

    tangent_start_min = mult*base_tangent
    tangent_start_max = tangent_start_min.Clone()
    
    if region=="left" or region=="right":
        b_func = BlendFunction("cosine", len(planes_gate), blend_layers)
        tangent_start_max.Rotate(math.radians(-mult*angle_constraint), rg.Vector3d.YAxis)
    elif region=="topleft" or region=="topright":
        b_func = BlendFunction("linear", len(planes_gate), blend_layers)
        tangent_start_min.Rotate(math.radians(-mult*angle_constraint), rg.Vector3d.YAxis)
    
    crvs = []
    
    for i in range(len(planes_gate)):
        plane_gate = planes_gate[i]
        plane_wall = planes_wall[i]
        
        vertices = [plane_gate.Origin, plane_wall.Origin]
        
        normal = mult*plane_gate.XAxis
        
        if region!="topleft" and region!="topright":
            if i<len(planes_gate)/2:
                tangent_start = b_func.get_value(i)*normal + (1-b_func.get_value(i))*tangent_start_min
            else:
                tangent_start = b_func.get_value(i)*normal + (1-b_func.get_value(i))*tangent_start_max
            
        else:
            tangent_start = b_func.get_value(i)*normal + (1-b_func.get_value(i))*tangent_start_min
        
        tangent_end = mult*plane_wall.XAxis
        c, c_len, c_domain = ghcomp.Interpolatet(vertices, tangent_start, tangent_end, knotstyle=0)
        crvs.append(c)

    return crvs

#bottom region?


crvs_region_left = generate_crvs(planes_gate_left, planes_wall_left, region="left")
crvs_region_right = generate_crvs(planes_gate_right, planes_wall_right, region="right")

crvs_region_left_top = generate_crvs(planes_gate_top, planes_wall_left_top, region="topleft")
crvs_region_right_top = generate_crvs(planes_gate_top, planes_wall_right_top, region="topright")

crvs_region_top = []
for i in range(len(crvs_region_left_top)):
    crvs = [crvs_region_left_top[i], crvs_region_right_top[i]]
    
    crv_joined = ghcomp.JoinCurves(crvs, False)
    crvs_region_top.append(crv_joined)
    
a=crvs_region_top
# ---------- end print_path_generation ----------
pt_3 = Point(print_path_generation.pts_gate_left)
pt_4 = Point(print_path_generation.pts_wall_left)
pt_5 = Point(print_path_generation.pts_gate_right)
pt_6 = Point(print_path_generation.pts_wall_right)
crv_12 = Curve(print_path_generation.crvs_region_left)
crv_13 = Curve(print_path_generation.crvs_region_right)
crv_14 = Curve(print_path_generation.crvs_region_left_top)
crv_15 = Curve(print_path_generation.crvs_region_right_top)
crv_16 = Curve(print_path_generation.crvs_region_top)
Y = UnitY(Factor=1)

# ----
print_path_generation_2 = GhPythonScript(
    max_layer_height=div_len.max_layer_height,
    avg_layer_height=div_len.avg_layer_height,
    min_layer_height=div_len.min_layer_height,
    angle_constraint=panel_2,
    crv_gate_left=flip.Curve,
    crv_gate_right=flip_2.Curve,
    crv_wall_left=curve_bottom_left,
    crv_wall_right=curve_bottom_right,
    crv_gate_top=define_gate.wall_crv_middle_b,
    crv_gate_bot=define_gate.wall_crv_middle,
    blend_layers=panel)  # -> out, pts_gate_left, pts_wall_left, pts_gate_right, pts_wall_right, crvs_region_left, crvs_region_right, crvs_region_left_top, crvs_region_right_top, crvs_region_top; inputs crv_gate_left: Curve, crv_gate_right: Curve, crv_wall_left: Curve, crv_wall_right: Curve, crv_gate_top: Curve, blend_layers: Int32; disabled
# ---------- print_path_generation_2: Python ----------
import Rhino.Geometry as rg
import ghpythonlib.components as ghcomp
import math



# planes gate left
tsl = crv_gate_left.DivideByLength(avg_layer_height, True)
div_count = len(tsl)
tsc = crv_gate_left.DivideByCount(div_count, True)
planes_gate_left = [crv_gate_left.PerpendicularFrameAt(t)[1] for t in tsc]

# planes gate right
tsc = crv_gate_right.DivideByCount(len(tsl), True)
planes_gate_right = [crv_gate_right.PerpendicularFrameAt(t)[1] for t in tsc]

# planes wall left
tsl = crv_wall_left.DivideByLength(avg_layer_height, True)
planes_wall_left = [crv_wall_left.PerpendicularFrameAt(t)[1] for t in tsl]

# planes wall right
tsr = crv_wall_right.DivideByLength(avg_layer_height, True)
planes_wall_right = [crv_wall_right.PerpendicularFrameAt(t)[1] for t in tsr]

top_wall_left = rg.Curve.Split(crv_wall_left, t=tsl[len(planes_gate_left)-1])[1]
top_wall_right = rg.Curve.Split(crv_wall_right, t=tsr[len(planes_gate_right)-1])[1]

#planes_wall_left_top = planes_wall_left[len(planes_gate_left):]
#planes_wall_right_top = planes_wall_right[len(planes_gate_right):]

# planes gate top
#tsc = crv_gate_top.DivideByCount(len(planes_wall_right_top), False)
#planes_gate_top = [crv_gate_top.PerpendicularFrameAt(t)[1] for t in tsc]

tsc = crv_gate_top.DivideByLength(max_layer_height, True)
planes_gate_top = [crv_gate_top.PerpendicularFrameAt(t)[1] for t in tsc[1:]]

twl = top_wall_left.DivideByCount(len(planes_gate_top)+1, False)
twr = top_wall_right.DivideByCount(len(planes_gate_top)+1, False)
planes_wall_left_top = [top_wall_left.PerpendicularFrameAt(t)[1] for t in twl]
planes_wall_right_top = [top_wall_right.PerpendicularFrameAt(t)[1] for t in twr]


class BlendFunction():
    def __init__(self, func_type, count, blend_layers=0):
        self.count = count
        self.blend_layers = int(min(blend_layers, count/2))
        self.func_type = func_type
        self.blend_type = {
            "linear" : self.blend_linear,
            "cosine" : self.blend_cosine
        }
    
    def get_value(self, value):
        return self.blend_type[self.func_type](value)
    
    def blend_cosine(self, value):
        if self.blend_layers != 0:
            if value <= self.blend_layers:
                step = (math.pi/self.blend_layers)*value
            elif value >= self.count-self.blend_layers:
                step = math.pi + (math.pi/self.blend_layers)*(value-(self.count-self.blend_layers))
            else:
                step = math.pi
        else:
            step = (2*math.pi/self.blend_layers)*value
        blendfactor = (math.cos(math.pi+step)+1)/2
        return blendfactor

    def blend_linear(self, value):
        blendfactor = (1/self.count)*value
        return blendfactor

def generate_crvs(planes_gate, planes_wall, region="left"):
    base_tangent = rg.Vector3d(1,0,0)
    if "left" in region:
        mult=-1
    elif "right" in region:
        mult = 1

    tangent_start_min = mult*base_tangent
    tangent_start_max = tangent_start_min.Clone()
    
    if region=="left" or region=="right":
        b_func = BlendFunction("cosine", len(planes_gate), blend_layers)
        tangent_start_max.Rotate(math.radians(-mult*angle_constraint), rg.Vector3d.YAxis)
    elif region=="topleft" or region=="topright":
        b_func = BlendFunction("linear", len(planes_gate), blend_layers)
        tangent_start_min.Rotate(math.radians(-mult*angle_constraint), rg.Vector3d.YAxis)
    
    crvs = []
    
    for i in range(len(planes_gate)):
        plane_gate = planes_gate[i]
        plane_wall = planes_wall[i]
        
        vertices = [plane_gate.Origin, plane_wall.Origin]
        
        normal = mult*plane_gate.XAxis
        
        if region!="topleft" and region!="topright":
            if i<len(planes_gate)/2:
                tangent_start = b_func.get_value(i)*normal + (1-b_func.get_value(i))*tangent_start_min
            else:
                tangent_start = b_func.get_value(i)*normal + (1-b_func.get_value(i))*tangent_start_max
            
        else:
            tangent_start = b_func.get_value(i)*normal + (1-b_func.get_value(i))*tangent_start_min
        
        tangent_end = mult*plane_wall.XAxis
        c, c_len, c_domain = ghcomp.Interpolatet(vertices, tangent_start, tangent_end, knotstyle=0)
        crvs.append(c)

    return crvs

#bottom region?


crvs_region_left = generate_crvs(planes_gate_left, planes_wall_left, region="left")
crvs_region_right = generate_crvs(planes_gate_right, planes_wall_right, region="right")

crvs_region_left_top = generate_crvs(planes_gate_top, planes_wall_left_top, region="topleft")
crvs_region_right_top = generate_crvs(planes_gate_top, planes_wall_right_top, region="topright")

crvs_region_top = []
for i in range(len(crvs_region_left_top)):
    crvs = [crvs_region_left_top[i], crvs_region_right_top[i]]
    
    crv_joined = ghcomp.JoinCurves(crvs, False)
    crvs_region_top.append(crv_joined)
# ---------- end print_path_generation_2 ----------
pt_7 = Point(print_path_generation_2.pts_gate_left)
pt_8 = Point(print_path_generation_2.pts_wall_right)
crv_17 = Curve(print_path_generation_2.crvs_region_left)
crv_18 = Curve(print_path_generation_2.crvs_region_right)
crv_19 = Curve(print_path_generation_2.crvs_region_left_top)
crv_20 = Curve(print_path_generation_2.crvs_region_right_top)
crv_21 = Curve(print_path_generation_2.crvs_region_top)
pt_9 = Point(print_path_generation_2.pts_wall_left)
pt_10 = Point(print_path_generation_2.pts_gate_right)

# ---- group: Fabrication (continued)
projecttomesh = CSharpScript(Curve=[crv_12, crv_13, crv_14, crv_15, crv_16, crv_17, crv_18, crv_19, crv_20, crv_21], Mesh=mesh, Direction=Y)  # -> out, A; inputs Curve: Curve, Mesh: Mesh, Direction: Vector3d
# ---------- projecttomesh: C# usings ----------
using System.IO;
using System.Linq;
using System.Data;
using System.Drawing;
using System.Reflection;
using System.Windows.Forms;
using System.Xml;
using System.Xml.Linq;
using System.Runtime.InteropServices;

using Rhino.DocObjects;
using Rhino.Collections;
using GH_IO;
using GH_IO.Serialization;
# ---------- projecttomesh: C# ----------
    if (null != Curve && null != Mesh && Direction.IsValid)
    {
      var tol = RhinoDoc.ActiveDoc.ModelAbsoluteTolerance;
      A = Curve.ProjectToMesh(Curve, Mesh, Direction, tol);
    }
# ---------- end projecttomesh ----------

# ----
# AM Information Model
number_slider = Slider(0.05, range=0..1)
layer_def = GhPythonScript(
    front_mesh=mesh,
    back_mesh=mesh_2,
    crvs_region_left=print_path_generation.crvs_region_left,
    crvs_region_right=print_path_generation.crvs_region_right,
    crvs_region_top=print_path_generation.crvs_region_top,
    div_length=number_slider,
    scale=list_3,
    double_layer=toggle)  # -> out, path_crvs_region_left, path_crvs_region_right, path_crvs_region_top, layers_left, layers_right, layers_top, path_length_left, path_length_right, path_length_top; inputs front_mesh: Mesh, back_mesh: Mesh, crvs_region_left: list of Curve, crvs_region_right: list of Curve, crvs_region_top: list of Curve, double_layer: Boolean; disabled
# ---------- layer_def: Python ----------
import os
import sys
import json

import Rhino.Geometry as rg
import ghpythonlib.components as ghcomp
import rhinoscriptsyntax as rs

from compas.geometry import Frame
from compas.geometry import Line
from compas.geometry import Vector

from am_information_model.model import Node
from am_information_model.model import Layer

max_r = (div_length*scale)/3
print max_r

def project_crvs(crvs, mesh, direction=rg.Vector3d.YAxis, offset=0, reversed=False):
    proj_crvs = []
    for crv in crvs:
        proj_crv = rg.Curve.ProjectToMesh(crv, mesh, direction, 0.001)[0]
        crv_end_pts = ghcomp.EndPoints(crv)
        proj_end_pts = ghcomp.EndPoints(proj_crv)
        if Vector.from_start_end(crv_end_pts[0], proj_end_pts[0]).length > 0.2:
            proj_crv.Reverse()
        if reversed:
            proj_crv.Reverse()
        proj_crv.Translate(0,offset,0)
        proj_crvs.append(proj_crv)
    return proj_crvs

#def mirror_curves(curves, offset):
#    new_crvs = []
#    for crv in curves:
#        crv_endpoints = ghcomp.EndPoints(crv)
#        mir_crv = ghcomp.Mirror(crv, rg.Plane.WorldZX)[0]
#        mir_crv.Translate(0,offset,0)
#        mir_crv_endpoints = ghcomp.EndPoints(mir_crv)
#        if Vector.from_start_end(crv_endpoints[0], mir_crv_endpoints[0]).length>offset:
#            mir_crv.Reverse()
#        new_crvs.append(mir_crv)
#    return new_crvs
#
#mirror_crvs_region_left = mirror_curves(proj_crvs_region_left, 0.320)
#mirror_crvs_region_right = mirror_curves(proj_crvs_region_right, 0.328)
#mirror_crvs_region_top = mirror_curves(proj_crvs_region_top, 0.328)

def layers_from_curves(curves, div, mir_curves=None, alternate=False, reversed=False):
    layers = []
    for j, crv in enumerate(curves):
        nodes = []
        crv_length = ghcomp.Length(crv)
        div_sections = int(crv_length/div)
        (pts, tans, pars) = ghcomp.DivideCurve(crv, div_sections, False)
        
        for i,pt in enumerate(pts):
            frame = Frame(pt, -rg.Vector3d(tans[i].X, 0, tans[i].Z), -Vector.Yaxis())
            nodes.append(Node(frame, radius=max_r))
        if not reversed:
            nodes.reverse()
        
        if mir_curves is not None:
            (mir_pts, mir_tans, mir_pars) = ghcomp.DivideCurve(mir_curves[j], div_sections, False)
            mir_nodes = []
            for i,pt in enumerate(mir_pts):
                frame = Frame(pt, -rg.Vector3d(tans[i].X, 0, tans[i].Z), -Vector.Yaxis())
                mir_nodes.append(Node(frame, radius=max_r))
            if reversed:
                mir_nodes.reverse()
            nodes.extend(mir_nodes)
        if alternate and j%2==0:
            nodes.reverse()
        layers.append(Layer.from_nodes(nodes))
    return layers

#layers_left = layers_from_curves(proj_crvs_region_left, mirror_crvs_region_left, div_length)
#layers_right = layers_from_curves(proj_crvs_region_right, mirror_crvs_region_right, div_length, reversed=True)
#layers_top = layers_from_curves(proj_crvs_region_top, mirror_crvs_region_top, div_length)

def create_closed_curves(crvs, mir_crvs, offset):
    new_crvs = []
    for i,crv in enumerate(crvs):
        crv_endpoints = ghcomp.EndPoints(crv)
        mir_crv_endpoints = ghcomp.EndPoints(mir_crvs[i])
        #if Vector.from_start_end(crv_endpoints[0], mir_crv_endpoints[0]).length>offset:
        #    mir_crv_endpoints.reverse()
        transverse_0 = rg.Line(mir_crv_endpoints[0], crv_endpoints[0])
        transverse_1 = rg.Line(crv_endpoints[1], mir_crv_endpoints[1])
        closed_crv = ghcomp.JoinCurves([crv, transverse_1, mir_crvs[i], transverse_0], False)
        new_crvs.append(closed_crv)
    return new_crvs

def get_lengths(curves):
    length = 0
    for crv in curves:
        length += crv.GetLength()*scale
    return length

#closed_crvs_region_left = create_closed_curves(proj_crvs_region_left, mirror_crvs_region_left, 0.328)
#closed_crvs_region_right = create_closed_curves(proj_crvs_region_right, mirror_crvs_region_right, 0.328)
#closed_crvs_region_top = create_closed_curves(proj_crvs_region_top, mirror_crvs_region_top, 0.328)

if double_layer:
    proj_crvs_region_left = project_crvs(crvs_region_left, front_mesh)
    proj_crvs_region_right = project_crvs(crvs_region_right, front_mesh, reversed=False)
    proj_crvs_region_top = project_crvs(crvs_region_top, front_mesh)
    
    back_vector = -rg.Vector3d.YAxis
    proj_crvs_region_left_back = project_crvs(crvs_region_left, back_mesh, direction=back_vector, offset=0.08)
    proj_crvs_region_right_back = project_crvs(crvs_region_right, back_mesh, direction=back_vector, offset=0.08, reversed=True)
    proj_crvs_region_top_back = project_crvs(crvs_region_top, back_mesh, direction=back_vector, offset=0.08)

    layers_left = layers_from_curves(proj_crvs_region_left, div_length, mir_curves=proj_crvs_region_left_back)
    layers_right = layers_from_curves(proj_crvs_region_right, div_length, mir_curves=proj_crvs_region_right_back, reversed=True)
    layers_top = layers_from_curves(proj_crvs_region_top, div_length, mir_curves=proj_crvs_region_top_back)
    
    path_crvs_region_left = create_closed_curves(proj_crvs_region_left, proj_crvs_region_left_back, 0.328)
    path_crvs_region_right = create_closed_curves(proj_crvs_region_right, proj_crvs_region_right_back, 0.328)
    path_crvs_region_top = create_closed_curves(proj_crvs_region_top, proj_crvs_region_top_back, 0.328)
    
    path_length_left = get_lengths(path_crvs_region_left)
    path_length_right = get_lengths(path_crvs_region_right)
    path_length_top = get_lengths(path_crvs_region_top)
    
else:
    path_crvs_region_left = project_crvs(crvs_region_left, front_mesh)
    path_crvs_region_right = project_crvs(crvs_region_right, front_mesh, reversed=True)
    path_crvs_region_top = project_crvs(crvs_region_top, front_mesh)
    
    layers_left = layers_from_curves(path_crvs_region_left, div_length, alternate=True)
    layers_right = layers_from_curves(path_crvs_region_right, div_length, alternate=True, reversed=True)
    layers_top = layers_from_curves(path_crvs_region_top, div_length, alternate=True)
    
    path_length_left = get_lengths(path_crvs_region_left)
    path_length_right = get_lengths(path_crvs_region_right)
    path_length_top = get_lengths(path_crvs_region_top)
# ---------- end layer_def ----------
cp = Plane(Plane(origin=(-1.021847973, 0.2250490768, -0.4446056533), x=(-0.01795929223, -0.9998379119, 0.001270365803), y=(0.9997696103, -0.0179729749, -0.01173449636)))
generate_assembly = GhPythonScript(
    create=create,
    centerplane=cp,
    scale=list_3,
    layers_left=layer_def.layers_left,
    layers_right=layer_def.layers_right,
    layers_top=layer_def.layers_top)  # -> am_model; inputs layers_left: list, layers_right: list, layers_top: list
# ---------- generate_assembly: Python ----------
import Rhino.Geometry as rg
import math
from scriptcontext import sticky as st


from compas.geometry import Frame
from compas.geometry import Transformation
from compas.geometry import Scale
from compas.geometry import Point

from compas_ghpython import draw_frame

from am_information_model.model import AMModel
from am_information_model.model import Layer

import Rhino.Geometry as rg

# initialize an empty assembly class

if "am_model" not in st:
    st["am_model"] = None

cp = centerplane
cf = Frame(cp.Origin, cp.XAxis, cp.YAxis)

S = Scale.from_factors([scale]*3, Frame.worldXY())
T = Transformation.from_frame_to_frame(Frame.worldXY(), cf)

def add_layers_to_am_model(amm, layers):
    for layer in layers:
        new_layer = layer.transformed(S)
        new_layer.transform(T)
        amm.add_layer(new_layer)

if create:
    new_amm = AMModel()
    add_layers_to_am_model(new_amm, layers_left)
    add_layers_to_am_model(new_amm, layers_right)
    add_layers_to_am_model(new_amm, layers_top)
    st["am_model"] = new_amm

am_model = st["am_model"]
# ---------- end generate_assembly ----------

mirror = Mirror(Geometry=[crv_12, crv_13, crv_16], Plane=move.Geometry)  # -> Geometry, Transform
panel_3 = Panel(layer_def.path_length_right)
panel_4 = Panel(layer_def.path_length_top)
panel_5 = Panel(layer_def.path_length_left)
crv_22 = Curve(layer_def.path_crvs_region_right)

# ---- group: Visualise
# Layer visualization
counter = CountThroughList(am_model=generate_assembly, start=start, stop=stop, step=step, step_back=back, reset=reset, full=full, interval=list_2)  # -> item, counter; inputs start: Boolean, stop: Boolean, step_back: Boolean
# ---------- counter: Python ----------
from scriptcontext import sticky as st
from compas_ghpython import update_component


L = list(am_model.layers())
# store data in component
guid = str(ghenv.Component.InstanceGuid)
counter_key = "counter_" + guid
running_key = "running_" + guid

if counter_key not in st:
    st[counter_key] = 0

if running_key not in st:
    st[running_key] = False
    

if st[running_key]:
    if st[counter_key] < len(L) - 1:
        st[counter_key] += 1
        update_component(ghenv, interval)
    else:
        st[counter_key] = 0
        st[running_key] = False
    
    
if start:
    st[running_key] = True

if stop:
    st[running_key] = False

if step:
    if st[counter_key] < len(L) - 1:
        st[counter_key] += 1

if step_back:
    if st[counter_key] > 0:
        st[counter_key] -= 1

if reset:
    st[counter_key] = 0

if full:
    st[counter_key] = len(L)-1

if len(L):
    item = L[st[counter_key]]



#st["visualisation_counter"] = st[counter_key]
counter = st[counter_key]
# ---------- end counter ----------
show = BooleanToggle(True)
show_2 = BooleanToggle(False)
idx = Panel(counter.counter)
draw = PythonScript(am_model=generate_assembly, show_all=show, show_counter=show_2, counter=idx)  # -> G, tool_planes_WCS, current_tool_plane, current_layer_planes; inputs counter: Int32
# ---------- draw: Python ----------
import os
import sys

import math

from compas_ghpython.artists import MeshArtist
from compas_ghpython import draw_frame

#from assembly_information_model.artist import AssemblyArtist


G = []

key_index = am_model.network.key_index()
keys = [key_index[key] for key in am_model.network.nodes()]
layers = [am_model.layer(key) for key in keys] 

tool_planes_WCS = [draw_frame(layer.node(0).frame) for layer in layers]

current_tool_plane = tool_planes_WCS[counter]
current_layer_planes = [draw_frame(frame) for frame in layers[counter].path]

if show_all and not show_counter:
    for layer in layers:
        for key, node in layer.nodes():
            plane = draw_frame(node.frame)
            G.append(plane)

if show_counter:
    for layer in layers[0:counter+1]:
        for key, node in layer.nodes():
            plane = draw_frame(node.frame)
            G.append(plane)
# ---------- end draw ----------
geo = Geometry(draw.G)
pln = Plane(draw.tool_planes_WCS)
pln_2 = Plane(draw.current_tool_plane)
pln_3 = Plane(draw.current_layer_planes)
# Info
preview_4 = CustomPreview(Geometry=geo, Shader=ColourSwatch(SwatchColor=RGBA(255, 186, 220, 146)))
