# Grasshopper definition window_in_wall_design_doublelayer_fab_stru.ghx (Grasshopper 1.0.7)
# plug-ins: karambaGH

reload = Button()
py = PythonScript(reload=reload)
# ---------- py: Python ----------
from compas_rhino.utilities.misc import get_tolerance
from compas_rhino.utilities.misc import unload_modules

from compas_ghpython import unload_modules

unload_modules("compas")
unload_modules("compas_fab")
unload_modules("ur_fabrication_control")
unload_modules("assembly_information_model")
unload_modules("am_information_model") 
unload_modules("window_in_wall")
# ---------- end py ----------
py_2 = PythonScript()  # -> HERE, DATA
# ---------- py_2: Python ----------
import os

HERE = os.path.dirname(ghdoc.Path)
DATA = os.path.abspath(os.path.join(HERE, "..", "data"))

#print(HERE)
#print(DATA)
# ---------- end py_2 ----------

# ---- group: DESIGN / Shape Initialization
list = ValueList({"circular", "persian", "interactive"}, selected="interactive")
crv_gate_right = Curve(<curve referenced from the Rhino model>)
crv_gate_left = Curve(<curve referenced from the Rhino model>)
width = Number(4.8)
height = Number(3.6)
elsize = Number(0.02)
create_wall = GhPythonScript(init=Button(), width=width, height=height, elsize=elsize)  # -> wall
# ---------- create_wall: Python ----------
from window_in_wall import Wall


# create wall
wall = Wall()


# construct COMPAS quad mesh from width and height
wall.create_quad_meshes_from_dimensions(width, height, elsize)

#print wall.mesh
# ---------- end create_wall ----------
define_gate = GhPythonScript(
    wall=create_wall,
    gate_type=list,
    gate_x=Slider(2.4, range=1..3),
    gate_size=Slider(0.9, range=0..2),
    gate_crv_left=crv_gate_left,
    gate_crv_right=crv_gate_right)  # -> out, wall, gate_crv_left, gate_crv_right, wall_crv_left, wall_crv_right, wall_crv_middle; inputs gate_crv_left: Curve, gate_crv_right: Curve
# ---------- define_gate: Python ----------
import math
import compas
import Rhino as rh
import ghpythonlib.components as ghcomp
from compas.datastructures import Mesh

import Rhino.Geometry as rg

# Create wall curves left and right
wall_crv_left = rg.Line(rg.Point3d(0,0,0), rg.Point3d(0,0,wall.height))
wall_crv_right = rg.Line(rg.Point3d(wall.width,0,0), rg.Point3d(wall.width,0,wall.height))

# Create gate curve
gate_crv_top = ghcomp.JoinCurves(curves=[gate_crv_left, gate_crv_right], preserve=False)
gate_end_pts = ghcomp.EndPoints(curve=gate_crv_top)
gate_crv_bottom = rg.Line(gate_end_pts[0], gate_end_pts[1])
gate_crv = ghcomp.JoinCurves(curves=[gate_crv_top, gate_crv_bottom], preserve=False)

if gate_type == "interactive":
    # Create wall curve above gate
    gate_left_pts = ghcomp.EndPoints(curve=gate_crv_left)
    if gate_left_pts[0].Z > gate_left_pts[1].Z:
        gate_top_pt = gate_left_pts[0]
    else:
        gate_top_pt = gate_left_pts[1]
    gate_x = gate_top_pt.X

# Define gate
for vertex in wall.mesh.vertices():
    # get x and z coordinates from vertex
    x_val = wall.mesh.vertex_attribute(vertex, name='x')
    z_val = wall.mesh.vertex_attribute(vertex, name='z')

    # calculate distance
    gate_rel_x = gate_x-x_val
    gate_rel_z = z_val

    #in order to avoid division by zero. should be cleaned up ASAP
    if gate_rel_x==0:
        gate_rel_x=0.000000001

    #this boolean will be set to True if vertex lies inside the gate 
    in_gate_vertex = False

    #for each gate tpye, the a corresponding function is called to check
    # to check if vertex lies inside the gate
    if gate_type=="circular":
        if wall.in_gate_circular(gate_size, gate_rel_x,gate_rel_z):
            in_gate_vertex = True
    elif gate_type=="persian":
        if wall.in_gate_persian(gate_size, gate_rel_x,gate_rel_z):
            in_gate_vertex = True
    elif gate_type=="interactive":
        point = rh.Geometry.Point3d(wall.mesh.vertex_attribute(vertex, name='x'), 0, wall.mesh.vertex_attribute(vertex, name='z') )
        point_in_gate = ghcomp.PointInCurve(point,gate_crv).relationship
        if point_in_gate == 2 or point_in_gate == 1: 
            in_gate_vertex = True

    if in_gate_vertex:
        # store new vertex attribute with the distance to the gate center
        wall.mesh.vertex_attribute(vertex,"x_disp", value=-gate_rel_x)
        wall.mesh.vertex_attribute(vertex,"z_disp", value=gate_rel_z)
        #in_gate flag indicates that this vertex lies in the gate
        wall.mesh.vertex_attribute(vertex,"in_gate", value=True)
        wall.gate_points.append(vertex)

if gate_type=="circular":
    center_pt = rg.Point3d(gate_x,0,0)
    start_pt = rg.Point3d(gate_x-gate_size,0,0)
    middle_left_pt = rg.Point3d(gate_x-(gate_size*(math.sqrt(2)/2)),0,gate_size*(math.sqrt(2)/2))
    middle_pt = rg.Point3d(gate_x,0,gate_size)
    middle_right_pt = rg.Point3d(gate_x+(gate_size*(math.sqrt(2)/2)),0,gate_size*(math.sqrt(2)/2))
    end_pt = rg.Point3d(gate_x+gate_size,0,0)
    gate_crv_left = ghcomp.Arc3Pt(start_pt, middle_left_pt, middle_pt)[0]
    gate_crv_right = ghcomp.Arc3Pt(middle_pt, middle_right_pt, end_pt)[0]
    
elif gate_type=="persian":
    center_pt = rg.Point3d(gate_x,0,0)
    start_pt = rg.Point3d(gate_x-gate_size,0,0)
    middle_left_pt = rg.Point3d(gate_x-(gate_size*(math.sqrt(2)/2)),0,gate_size*(math.sqrt(2)/2))
    middle_pt = rg.Point3d(gate_x,0,gate_size)
    middle_right_pt = rg.Point3d(gate_x+(gate_size*(math.sqrt(2)/2)),0,gate_size*(math.sqrt(2)/2))
    end_pt = rg.Point3d(gate_x+gate_size,0,0)

    gate_crv_left = ghcomp.Arc3Pt(start_pt, middle_left_pt, middle_pt)[0]
    gate_crv_right = ghcomp.Arc3Pt(middle_pt, middle_right_pt, end_pt)[0]
    
# Create wall curve above gate
gate_left_pts = ghcomp.EndPoints(curve=gate_crv_left)
if gate_left_pts[0].Z > gate_left_pts[1].Z:
    gate_top_pt = gate_left_pts[0]
else:
    gate_top_pt = gate_left_pts[1]
wall_crv_middle = rg.Line(gate_top_pt, rg.Point3d(gate_top_pt.X, gate_top_pt.Y, wall.height))
# ---------- end define_gate ----------
crv = Curve(define_gate.wall_crv_middle)
crv_2 = Curve(define_gate.gate_crv_left)
crv_3 = Curve(define_gate.gate_crv_right)
crv_4 = Curve(define_gate.wall_crv_left)
crv_5 = Curve(define_gate.wall_crv_right)
preview = CustomPreview(Geometry=[crv_2, crv_3, crv_4, crv_5, crv], Material=ColourSwatch(SwatchColor=RGB(0, 0, 0)))

# ----
up_amp = Slider(0, range=0..0.3)

# ---- group: DESIGN / Shape Manipulation
down_freq = Slider(1.8, range=1..3)
up_phase = Slider(0.1, range=0..3)
up_amp_2 = Slider(0.08, range=0..0.3)
up_freq = Slider(1, range=1..3)
displacement = GhPythonScript(wall=define_gate.wall, comp_displ=Toggle(True))  # -> out, wall
# ---------- displacement: Python ----------
from compas.rpc import Proxy

if comp_displ:
    #wall_methods_numpy = Proxy('window_in_wall.wall_methods_numpy')
    wall_methods_pde = Proxy('window_in_wall.wall_methods_pde')
    #wall_methods_numpy.stop_server() #if changes need to be reloaded
    #wall_methods_numpy.start_server()
    
    # compute displacement
    #solX, solZ = wall_methods_numpy.compute_displacement(wall.mesh,wall.gate_points, wall.x_size, wall.z_size)
    solX = wall_methods_pde.compute_displacement_x(wall.mesh, wall.gate_points, wall.x_size, wall.z_size)
    solZ = wall_methods_pde.compute_displacement_z(wall.mesh, wall.gate_points, wall.x_size, wall.z_size)
    
    # update vertex attributes with displacement values
    for v, data in wall.mesh.vertices(data=True):        
        wall.mesh.vertex_attribute(v, "x_disp", value=solX[v]) #value=solX[n_from_ij(i,j, wall.z_size)]
        wall.mesh.vertex_attribute(v, "z_disp", value=solZ[v]) #value=solZ[n_from_ij(i,j, wall.z_size)]
    
    # displace the vertices (for preview only)
    # wall.displace_vertices()
    #solmat = np.reshape(solX, (-1, n))
# ---------- end displacement ----------
wave = GhPythonScript(
    wall=displacement.wall,
    wave=Toggle(True),
    up_amp=up_amp,
    up_freq=up_freq,
    up_phase=up_phase,
    down_amp=up_amp_2,
    down_freq=down_freq,
    down_phase=up_phase)  # -> out, wall; inputs wave: Boolean
# ---------- wave: Python ----------
if wave:
    #wall.undulate(amp, freq, phase)
    #wall.undulate(up_amp, up_freq, up_phase, down_amp, down_freq, down_phase)
    wall.undulate_with_displ(up_amp, up_freq, up_phase, down_amp, down_freq, down_phase)
    #wall.undulate_with_displ(amp, freq, phase)
# ---------- end wave ----------

# ----
medges = MeshEdges()  # -> NakedEdges, InteriorEdges, NonManifoldEdges; disabled

# ---- group: Structure / Loads
Z = UnitZ(Factor=1)  # -> expr("-x", UnitVector)
loads = LoadsKaramba3D(Vector=Z, LCase=0, mode="Gravity")

# ---- group: Visualization
# VISUALIZATION
toggle = BooleanToggle(True)
visualize = GhPythonScript(wall=wave.wall, show_mesh=toggle, show_vertices_gate=Toggle(True), show_vector_field=Toggle(False))  # -> out, rhmesh, rhmesh_offset, vertices_gate, vertices_all, disp_vectors
# ---------- visualize: Python ----------
from compas_ghpython.artists import MeshArtist
import Rhino.Geometry as rg

rh_mesh = []
vertices_gate = []
vertices_all = []
disp_vectors = []


if show_mesh:
    # Mesh Artist for visualization
    artist = MeshArtist(wall.mesh)
    
    #vertices = artist.draw_vertices()
    #edges = artist.draw_edges()
    #faces = artist.draw_faces()
    #labels = {key: key for key in mesh.vertices()}
    
    rhmesh = artist.draw()
    
    artist = MeshArtist(wall.mesh_offset)
    rhmesh_offset = artist.draw()

if show_vertices_gate:
    # draw gate points
    v = []
    for vertex in wall.mesh.vertices():
        gp = wall.mesh.vertex_attribute(vertex, name='in_gate')
        if gp: v.append(vertex)
    
    if len(v): vertices_gate = artist.draw_vertices(vertices=v)


if show_vector_field:
    x_disp = []
    z_disp = []
    
    for vertex in wall.mesh.vertices():
        x_disp.append(wall.mesh.vertex_attribute(vertex, name='x_disp'))
        z_disp.append(wall.mesh.vertex_attribute(vertex, name='z_disp'))
    
    disp_vectors = [rg.Vector3d(x_disp[i], 0, z_disp[i])/5 for i in range(len(x_disp))]

    vertices_all = artist.draw_vertices()
# ---------- end visualize ----------
mesh = Mesh(visualize.rhmesh)
pt = Point(visualize.vertices_gate)
pt_2 = Point(visualize.vertices_all)
vec = Vector(visualize.disp_vectors)
preview_2 = CustomPreview(Geometry=pt, Material=ColourSwatch(SwatchColor=RGB(0, 0, 0)))
vdisex = VectorDisplayEx(Point=pt_2, Vector=vec, Colour=ColourSwatch(SwatchColor=RGB(42, 0, 255)), Width=1)

# ----
mesh_2 = Mesh(visualize.rhmesh_offset)

# ---- group: Visualization (continued)
preview_3 = CustomPreview(Geometry=[mesh, mesh_2], Material=ColourSwatch(SwatchColor=RGBA(255, 207, 207, 55)))

# ---- group: Fabrication
# FABRICATION
list_2 = ValueList({"1:10": 0.1, "1:5": 0.2}, selected="1:10")
div_len = GhPythonScript(scalefactor=list_2)  # -> out, div_length
# ---------- div_len: Python ----------
div_length = 0.0045 / scalefactor

print (div_length)
# ---------- end div_len ----------
print_path_generation = GhPythonScript(
    div_length=div_len.div_length,
    angle_constraint="35",
    crv_gate_left=define_gate.gate_crv_left,
    crv_gate_right=define_gate.gate_crv_right,
    crv_wall_left=define_gate.wall_crv_left,
    crv_wall_right=define_gate.wall_crv_right,
    crv_gate_top=define_gate.wall_crv_middle,
    blend_layers="20")  # -> out, pts_gate_left, pts_wall_left, pts_gate_right, pts_wall_right, crvs_region_left, crvs_region_right, crvs_region_left_top, crvs_region_right_top, crvs_region_top; inputs crv_gate_left: Curve, crv_gate_right: Curve, crv_wall_left: Curve, crv_wall_right: Curve, crv_gate_top: Curve, blend_layers: Int32
# ---------- print_path_generation: Python ----------
import Rhino.Geometry as rg
import ghpythonlib.components as ghcomp
import math



# planes gate left
tsl = crv_gate_left.DivideByLength(div_length, True)
div_count = len(tsl)
tsc = crv_gate_left.DivideByCount(div_count, True)
planes_gate_left = [crv_gate_left.PerpendicularFrameAt(t)[1] for t in tsc]

# planes gate right
tsc = crv_gate_right.DivideByCount(len(tsl), True)
planes_gate_right = [crv_gate_right.PerpendicularFrameAt(t)[1] for t in tsc]

# planes wall left
tsl = crv_wall_left.DivideByLength(div_length, True)
planes_wall_left = [crv_wall_left.PerpendicularFrameAt(t)[1] for t in tsl]

# planes wall right
tsl = crv_wall_right.DivideByLength(div_length, True)
planes_wall_right = [crv_wall_right.PerpendicularFrameAt(t)[1] for t in tsl]

planes_wall_left_top = planes_wall_left[len(planes_gate_left):]
planes_wall_right_top = planes_wall_right[len(planes_gate_left):]

# planes gate top
tsc = crv_gate_top.DivideByCount(len(planes_wall_right_top), False)
planes_gate_top = [crv_gate_top.PerpendicularFrameAt(t)[1] for t in tsc]


class BlendFunction():
    def __init__(self, func_type, count, blend_layers=0):
        self.count = count
        self.blend_layers = int(min(blend_layers, count/2))
        self.func_type = func_type
        self.blend_type = {
            "linear" : self.blend_linear,
            "cosine" : self.blend_cosine
        }
    
    def get_value(self, value):
        return self.blend_type[self.func_type](value)
    
    def blend_cosine(self, value):
        if self.blend_layers != 0:
            if value <= self.blend_layers:
                step = (math.pi/self.blend_layers)*value
            elif value >= self.count-self.blend_layers:
                step = math.pi + (math.pi/self.blend_layers)*(value-(self.count-self.blend_layers))
            else:
                step = math.pi
        else:
            step = (2*math.pi/self.blend_layers)*value
        blendfactor = (math.cos(math.pi+step)+1)/2
        return blendfactor

    def blend_linear(self, value):
        blendfactor = (1/self.count)*value
        return blendfactor

def generate_crvs(planes_gate, planes_wall, region="left"):
    base_tangent = rg.Vector3d(1,0,0)
    if "left" in region:
        mult=-1
    elif "right" in region:
        mult = 1

    tangent_start_min = mult*base_tangent
    tangent_start_max = tangent_start_min.Clone()
    
    if region=="left" or region=="right":
        b_func = BlendFunction("cosine", len(planes_gate), blend_layers)
        tangent_start_max.Rotate(math.radians(-mult*angle_constraint), rg.Vector3d.YAxis)
    elif region=="topleft" or region=="topright":
        b_func = BlendFunction("linear", len(planes_gate), blend_layers)
        tangent_start_min.Rotate(math.radians(-mult*angle_constraint), rg.Vector3d.YAxis)
    
    crvs = []
    
    for i in range(len(planes_gate)):
        plane_gate = planes_gate[i]
        plane_wall = planes_wall[i]
        
        vertices = [plane_gate.Origin, plane_wall.Origin]
        
        normal = mult*plane_gate.XAxis
        
        if region!="topleft" and region!="topright":
            if i<len(planes_gate)/2:
                tangent_start = b_func.get_value(i)*normal + (1-b_func.get_value(i))*tangent_start_min
            else:
                tangent_start = b_func.get_value(i)*normal + (1-b_func.get_value(i))*tangent_start_max
            
        else:
            tangent_start = b_func.get_value(i)*normal + (1-b_func.get_value(i))*tangent_start_min
        
        tangent_end = mult*plane_wall.XAxis
        c, c_len, c_domain = ghcomp.Interpolatet(vertices, tangent_start, tangent_end, knotstyle=0)
        crvs.append(c)

    return crvs

crvs_region_left = generate_crvs(planes_gate_left, planes_wall_left, region="left")
crvs_region_right = generate_crvs(planes_gate_right, planes_wall_right, region="right")

crvs_region_left_top = generate_crvs(planes_gate_top, planes_wall_left_top, region="topleft")
crvs_region_right_top = generate_crvs(planes_gate_top, planes_wall_right_top, region="topright")

crvs_region_top = []
for i in range(len(crvs_region_left_top)):
    crvs = [crvs_region_left_top[i], crvs_region_right_top[i]]
    
    crv_joined = ghcomp.JoinCurves(crvs, False)
    crvs_region_top.append(crv_joined)
# ---------- end print_path_generation ----------
pt_3 = Point(print_path_generation.pts_gate_left)
pt_4 = Point(print_path_generation.pts_wall_left)
pt_5 = Point(print_path_generation.pts_gate_right)
pt_6 = Point(print_path_generation.pts_wall_right)
crv_6 = Curve(print_path_generation.crvs_region_left)
crv_7 = Curve(print_path_generation.crvs_region_right)
crv_8 = Curve(print_path_generation.crvs_region_left_top)
crv_9 = Curve(print_path_generation.crvs_region_right_top)
crv_10 = Curve(print_path_generation.crvs_region_top)
Y = UnitY(Factor=1)
projecttomesh = CSharpScript(Curve=[crv_6, crv_7, crv_8, crv_9, crv_10], Mesh=mesh, Direction=Y)  # -> out, A; inputs Curve: Curve, Mesh: Mesh, Direction: Vector3d
# ---------- projecttomesh: C# usings ----------
using System.IO;
using System.Linq;
using System.Data;
using System.Drawing;
using System.Reflection;
using System.Windows.Forms;
using System.Xml;
using System.Xml.Linq;
using System.Runtime.InteropServices;

using Rhino.DocObjects;
using Rhino.Collections;
using GH_IO;
using GH_IO.Serialization;
# ---------- projecttomesh: C# ----------
    if (null != Curve && null != Mesh && Direction.IsValid)
    {
      var tol = RhinoDoc.ActiveDoc.ModelAbsoluteTolerance;
      A = Curve.ProjectToMesh(Curve, Mesh, Direction, tol);
    }
# ---------- end projecttomesh ----------

# ----
demesh = DeconstructMesh(Mesh=mesh)  # -> Vertices, Faces, Colours, Normals; disabled
cp = ClosestPoint(Point=pt, Cloud=demesh.Vertices)  # -> ClosestPoint, CPIndex, Distance; disabled
deletev = DeleteVertices(Mesh=mesh, Indices=cp.CPIndex, Shrink=True)  # disabled

divide = DivideCurve(Count=300, Kinks=False)  # -> Points, Tangents, Parameters; disabled
pdecon = Deconstruct()  # -> XComponent, YComponent, ZComponent; disabled
sort = SortList(Keys=pdecon.ZComponent)  # -> Keys, ValuesA; disabled
Z_2 = UnitZ(Factor=1)  # disabled
pdecon_2 = Deconstruct(Point=divide.Points)  # -> XComponent, YComponent, ZComponent; disabled
equals = Equality(FirstNumber=sort.Keys, SecondNumber=0)  # -> Equality, Inequality; disabled
sort_2 = SortList(Keys=pdecon_2.ZComponent, ValuesA=divide.Points)  # -> Keys, ValuesA; disabled
dispatch = Dispatch(List=sort.ValuesA, DispatchPattern=equals.Equality)  # -> ListA, ListB; disabled
equals_2 = Equality(FirstNumber=sort_2.Keys, SecondNumber=0)  # -> Equality, Inequality; disabled
dispatch_2 = Dispatch(List=sort_2.ValuesA, DispatchPattern=equals_2.Equality)  # -> ListA, ListB; disabled
number_slider = Slider(10, range=0..10)  # disabled
pt_7 = Point(dispatch_2.ListB)  # disabled
preview_4 = CustomPreview(Material={diffuse=RGB(220, 20, 60), emission=RGB(220, 20, 60), shine=0.5, specular=RGB(255, 255, 255), transparency=0})  # disabled
preview_5 = CustomPreview(Material={diffuse=RGB(65, 105, 225), emission=RGB(65, 105, 225), shine=0.5, specular=RGB(255, 255, 255), transparency=0})  # disabled
meshcp = MeshClosestPoint(Point=pt_7, Mesh=deletev)  # -> Point, Index, Parameter; disabled
multiplication = Multiplication(B=number_slider)  # disabled
vdisex_2 = VectorDisplayEx(Vector=multiplication, Colour=RGB(164, 118, 207), Width=2)  # disabled

# ---- group: Structure
# STRUCTURE
mesh_3 = Mesh(visualize.rhmesh)
pt_8 = Point(visualize.vertices_gate)

# ---- group: Structure / Shell Element
wall_mesh = WallMesh(mesh=mesh_3, pt=pt_8)
meshtoshell = MeshToShellKaramba3D(Mesh=wall_mesh, LimitDistance_m=0.005)  # -> Element, Points, Info

# ---- group: Structure / Supports
support_pts = SupportPts(pt=meshtoshell.Points)
supp = SupportKaramba3D(PosInd=support_pts, menu=[buttons(on, on, on, on, on, on)])

# ---- group: Structure / Structural Analysis
assemble = AssembleModelKaramba3D(Elem=meshtoshell.Element, Support=flatten(supp), Load=loads, LimitDistance_m=0.005)  # -> Model, Info, Mass_kg, CenterOfGravity
analyze = AnalyzeKaramba3D(Model=assemble.Model)  # -> CalculatedModel, MaximumDisplacement_cm, ResultingForceOfGravity_kN, ElasticEnergy_kNm

# ---- group: Structure / Principal Stress Lines
sources_stresslines = SourcesStressLines(M=wall_mesh)
shelllineresults = LineResultsOnShellsKaramba3D(
    AnalyzedModel=analyze.CalculatedModel,
    LayerPosition=0,
    ListOfSourcesOfPrincipalStressLinesLinesPoints=sources_stresslines,
    SegmentLength_m=1,
    DA_deg=5,
    mode="PrincStress")  # -> AnalyzedModel, flatten(Lines1), flatten(Lines2)
princstress1 = CustomPreview(
    Geometry=shelllineresults.Lines1,
    Material={diffuse=RGB(220, 20, 60), emission=RGB(220, 20, 60), shine=0.5, specular=RGB(255, 255, 255), transparency=0})
princstress1_2 = CustomPreview(
    Geometry=shelllineresults.Lines2,
    Material={diffuse=RGB(65, 105, 225), emission=RGB(65, 105, 225), shine=0.5, specular=RGB(255, 255, 255), transparency=0})

# ==== cluster WallMesh
mesh = ClusterInput()
pt = ClusterInput()
mesh_2 = Mesh(mesh)
pt_2 = Point(pt)
demesh = DeconstructMesh(Mesh=mesh_2)  # -> Vertices, Faces, Colours, Normals
cp = ClosestPoint(Point=pt_2, Cloud=demesh.Vertices)  # -> ClosestPoint, CPIndex, Distance
deletev = DeleteVertices(Mesh=mesh_2, Indices=cp.CPIndex, Shrink=True)
M = ClusterOutput(deletev)

# ==== cluster SupportPts
pt = ClusterInput()
pt_2 = Point(pt)
pdecon = Deconstruct(Point=pt_2)  # -> XComponent, YComponent, ZComponent
sort = SortList(Keys=pdecon.ZComponent, ValuesA=pt_2)  # -> Keys, ValuesA
equals = Equality(FirstNumber=sort.Keys, SecondNumber=0)  # -> Equality, Inequality
dispatch = Dispatch(List=sort.ValuesA, DispatchPattern=equals.Equality)  # -> ListA, ListB
A = ClusterOutput(dispatch.ListA)

# ==== cluster SourcesStressLines
M = ClusterInput()
border_vertices = BorderVertices(mesh=M)
meshcp = MeshClosestPoint(Point=border_vertices, Mesh=M)  # -> Point, Index, Parameter
P = ClusterOutput(meshcp.Point)

# ==== cluster BorderVertices
mesh = ClusterInput()
mesh_2 = Mesh(mesh)
nakededge = MeshNakedEdge(Mesh=mesh_2)  # -> V, A, B
item = ListItem(List=nakededge.V, Index=nakededge.B, Wrap=True)
item_2 = ListItem(List=nakededge.V, Index=nakededge.A, Wrap=True)
ln = Line(StartPoint=item_2, EndPoint=item)
join = JoinCurves(Curves=ln, Preserve=False)
divide = DivideCurve(Curve=join, Count=1000, Kinks=False)  # -> Points, Tangents, Parameters
pdecon = Deconstruct(Point=divide.Points)  # -> XComponent, YComponent, ZComponent
sort = SortList(Keys=pdecon.ZComponent, ValuesA=divide.Points)  # -> Keys, ValuesA
equals = Equality(FirstNumber=sort.Keys, SecondNumber=0)  # -> Equality, Inequality
dispatch = Dispatch(List=sort.ValuesA, DispatchPattern=equals.Equality)  # -> ListA, ListB
pt = Point(dispatch.ListB)
pt_2 = ClusterOutput(pt)
