# Grasshopper definition window_in_wall_fabrication.ghx (Grasshopper 1.0.7)
# plug-ins: Pufferfish

vec = Vector(Vector(-0.4999369053, 0, 0.007942964462))
unit = UnitVector(Vector=vec)
multiplication = Multiplication(A=unit, B=Slider(0.3, range=0..1))
# 3.
pi = Pi(Factor=Slider(-0.5, range=-1..1))
pln = Plane(Plane(origin=(-0.8394120263, 0.03323092676, -0.4597936574), x=(8.598218093e-06, -0.9999998535, 0.0005411791234), y=(-0.9998738107, 0, 0.01588592892)))

reload = Button()
py = PythonScript(reload=reload)
# ---------- py: Python ----------
from compas_rhino.utilities.misc import get_tolerance
from compas_rhino.utilities.misc import unload_modules

from compas_ghpython import unload_modules

unload_modules("compas")
unload_modules("compas_fab")
unload_modules("ur_fabrication_control")
unload_modules("assembly_information_model")
unload_modules("am_information_model")
unload_modules("window_in_wall")
# ---------- end py ----------
py_2 = PythonScript()  # -> HERE, DATA
# ---------- py_2: Python ----------
import os

HERE = os.path.dirname(ghdoc.Path)
DATA = os.path.abspath(os.path.join(HERE, "..", "data"))

#print(HERE)
#print(DATA)
# ---------- end py_2 ----------

xy = XYPlane(Origin=Point(0, 0, 0))
xy_2 = XYPlane(Origin=pln)

# ----
# 1.
# Geometry generation
button = Button()
width = Number(3.5)
height = Number(3.2)
elsize = Number(0.025)
create_wall = GhPythonScript(init=button, width=width, height=height, elsize=elsize)  # -> out, wall
# ---------- create_wall: Python ----------
from window_in_wall import Wall


# create wall
wall = Wall()


# construct COMPAS quad mesh from width and height
wall.create_quad_mesh_from_dimensions(width, height, elsize)
# ---------- end create_wall ----------

wave = GhPythonScript(
    wall=create_wall.wall,
    wave=Toggle(True),
    amp=Slider(0.2, range=0..1),
    freq=Slider(1, range=1..5),
    phase=Slider(0, range=0..3))  # -> out, wall; inputs wave: Boolean
# ---------- wave: Python ----------
if wave:
    wall.undulate(amp, freq, phase)
# ---------- end wave ----------

# ---- group: Visualise
list = ValueList({"20", "50", "100", "500", "1000", "5000"}, selected="20")
back = Button()
reset = Button()
start = Button()
stop = Button()
step = Button()
full = Button()

# ----
pdecon = Deconstruct(Point=pln)  # -> XComponent, YComponent, ZComponent
number_slider = Slider(0.009, range=-0.01..0.1)
Z = UnitZ(Factor=number_slider)
py_3 = PythonScript()  # -> DATA
# ---------- py_3: Python ----------
import os
import mobile_additive_manufacturing

package_path = os.path.dirname(mobile_additive_manufacturing.__file__)
DATA = os.path.abspath(os.path.join(package_path,"../../data"))

print(package_path)
print(DATA)
# ---------- end py_3 ----------
list_2 = ValueList({"ur3.urdf", "ur3_rot.urdf", "ur5.urdf", "ur10.urdf", "ur3e.urdf", "ur5e.urdf", "ur10e.urdf", "ur10e_rot.urdf"}, selected="ur10e_rot.urdf")
py_4 = PythonScript()  # -> DATA
# ---------- py_4: Python ----------
import os
import ur_fabrication_control

package_path = os.path.dirname(ur_fabrication_control.__file__)
DATA = os.path.abspath(os.path.join(package_path,"../../data"))

print(package_path)
print(DATA)
# ---------- end py_4 ----------
list_3 = ValueList({"ur3.srdf", "ur5.srdf", "ur10.srdf", "ur3e.srdf", "ur5e.srdf", "ur10e.srdf"}, selected="ur10e.srdf")

# ----
# Robot Model
# Load Model
list_4 = ValueList({"ur_description", "ur_e_description", "ur_setups"}, selected="ur_e_description")
py_5 = PythonScript(data_path=py_4, package=list_4, urdf_name=list_2, srdf_name=list_3)  # -> loaders, urdf_filename, srdf_filename
# ---------- py_5: Python ----------
import os
from compas.robots import LocalPackageMeshLoader

path = os.path.join(data_path, "robot_description")

#loaders
packages = ["ur_description", "ur_e_description", "ur_end_effectors", "ur_setups"]
loaders = [LocalPackageMeshLoader(path, pck) for pck in packages]

#files
package_path = os.path.join(path, package)
print package_path

urdf_filename = os.path.join(package_path, "urdf", urdf_name)
srdf_filename = os.path.join(package_path, srdf_name)

assert os.path.isfile(urdf_filename)
assert os.path.isfile(srdf_filename)
# ---------- end py_5 ----------
load = Button()
units = ValueList({"m": 1, "cm": 100, "mm": 1000}, selected="m")
create = PythonScript(load=load, loaders=py_5.loaders, urdf_filename=py_5.urdf_filename, srdf_filename=py_5.srdf_filename, scale_factor=units)  # -> out, robot; inputs load: Boolean, loaders: list
# ---------- create: Python ----------
import os
from scriptcontext import sticky as st

import compas

from compas.robots import RobotModel
from compas.robots import LocalPackageMeshLoader

from compas_fab.robots import Robot
from compas_fab.robots import RobotSemantics
from compas_fab.ghpython import RobotArtist

compas.PRECISION = '12f'

# store robot in component
guid = str(ghenv.Component.InstanceGuid)
robot_key = "robot"

if robot_key not in st:
    st[robot_key] = None

print loaders
if load:
    model = RobotModel.from_urdf_file(urdf_filename)
    
    model.load_geometry(*loaders)
    artist = RobotArtist(model)
    semantics = RobotSemantics.from_srdf_file(srdf_filename, model)
    robot = Robot(model, artist, semantics, client=None)
    
    st[robot_key] = robot

robot = st[robot_key]


if robot:
    robot.scale(scale_factor)
# ---------- end create ----------
robot = Data(create.robot)

# ----
# Tool
list_5 = ValueList({"measurement_tool": 0, "clay_extruder_7mm": 1, "clay_extruder_7mm_unit_x": 2}, selected="clay_extruder_7mm")
panel = Panel("Attach a custom tool")
show = BooleanToggle(False)
python = PythonScript(data_path=py_3, tool=list_5, show=show)  # -> tool, M
# ---------- python: Python ----------
import os, math
from compas.geometry import Frame, Rotation
from compas.datastructures import Mesh
from compas_ghpython.artists import MeshArtist
from compas_fab.robots import Tool

tolerance = 0

if tool == 0:
    filename = 'measurement_tool_zaxis.stl'
    ee_frame = Frame([0, 0, 0.109], [1, 0, 0], [0, 1, 0])

elif tool == 1:
    filename = 'clay_extruder_7mm.stl'
    # real frame:
    ee_frame = Frame([-0.000502, -0.105348, 0.0662,], [1, 0, 0], [0, 0, 1])
    
    # test frame:
    # ee_frame = Frame([0.0, 0.0, 0.1,], [1, 0, 0], [0, 1, 0])
elif tool == 2:
    filename = 'clay_extruder_7mm_unit_x.stl'
    # non-rotated frame:
    ee_frame = Frame([0.0662, 0.000502, 0.105348], [1, 0, 0], [0, 1, 0])


data_path = os.path.join(data_path, "tool_geometry")
fullfilename = os.path.join(data_path, filename)
print fullfilename

ee_mesh = Mesh.from_stl(fullfilename)

#R = Rotation.from_axis_and_angle(ee_frame.zaxis, math.radians(180), point=ee_frame.point)
#ee_frame.transform(R)

if show:
    artist = MeshArtist(ee_mesh)
    M = artist.draw()

tool = Tool(ee_mesh, ee_frame)
# ---------- end python ----------
py_6 = PythonScript(robot=robot, tool=python.tool, attach=Toggle(True))  # -> a
# ---------- py_6: Python ----------
if attach:
    robot.attach_tool(tool)
else:
    robot.detach_tool()
# ---------- end py_6 ----------

ext_ip = ValueList({"192.168.10.10", "192.168.10.20", "192.168.10.11", "192.168.10.12", "127.0.0.1", "192.168.10.111", "192.168.0.30", "192.168.10.50"}, selected="192.168.10.50")
ext_port = ValueList({"50003", "50004"}, selected="50004")

# ----
# 0.
# Settings
# --> Set your IP address
# --> Set robot IP address
server_ip = ValueList({"192.168.10.44", "192.168.10.12", "192.168.10.11", "192.168.10.10", "192.168.10.2", "127.0.0.1", "192.168.10.111", "192.168.0.30"}, selected="192.168.10.11")
ur_ip = ValueList({"192.168.10.10", "192.168.10.20", "192.168.10.11", "192.168.10.12", "127.0.0.1", "192.168.10.111", "192.168.0.30"}, selected="192.168.10.20")
server_port = ValueList({"50002", "50003", "50004", "50005"}, selected="50002")
ur_port = ValueList({"30002"}, selected="30002")
globals = PythonScript(
    server_address=server_ip,
    server_port=server_port,
    ur_ip=ur_ip,
    ur_port=ur_port,
    ext_ip=ext_ip,
    ext_port=ext_port,
    clear=Button())  # inputs server_port: Int32
# ---------- globals: Python ----------
from scriptcontext import sticky as st

st["server_address"] = server_address
st["server_port"] = server_port

st["ur_ip"] = ur_ip
st["ur_port"] = ur_port

st["ext_ip"] = ext_ip
st["ext_port"] = ext_port


if clear:
    st.clear()
# ---------- end globals ----------

# ----
# Check if UR robot
#  is available
ping = Button()
py_7 = PythonScript(ip=ur_ip, ping=ping)  # -> out, trigger
# ---------- py_7: Python ----------
from scriptcontext import sticky as st
from ur_fabrication_control.direct_control.utilities import is_available

guid = str(ghenv.Component.InstanceGuid)
txt_key = "txt_" + guid
if txt_key not in st:
    st[txt_key] = ""

if ping:
    
    available = is_available(ip)
    
    if available:
        st[txt_key] = "%s is up!" % ip
        trigger = True
    else:
        st[txt_key] = "%s is down!" % ip
        trigger = False

print(st[txt_key])
# ---------- end py_7 ----------
panel_2 = Panel(py_7.out)

# ---- group: forward kinematics
a4 = Slider(0, range=-360..360)
# Configuration
a1 = Slider(0, range=-360..360)
a2 = Slider(-90, range=-360..360)
a3 = Slider(90, range=-360..360)
a5 = Slider(90, range=-360..360)
a6 = Slider(0, range=-360..360)
jp = GhPythonScript()  # -> joint_positions
# ---------- jp: Python ----------
import math

joint_positions = [0,-90,90,0,90,0]
joint_positions = [math.radians(a) for a in joint_positions]
#joint_positions = [-3.136, -0.328, -1.218, 3.129, 0.852, 0.008]
#joint_positions = [0] * 6



#joint_positions = [1.6239667567485938, 0.25439606475392273, 4.409424838594969-2*3.14, 3.1901607306255908, 1.5707963267948954, 0.053170429953696939]
#joint_positions = [1.598543436748912, 0.23021224965157744, 4.712232135219824-2*3.14, 6.0531299026928744, 4.7123889803846915, 0.027747109954015234]
#joint_positions = [-1.1373533430447322, 4.0117247163121572, 5.4083762087596021-2*3.14, 1.5754733624925168, 4.7123889803846879, 3.5750356373399574]
print joint_positions
# ---------- end jp ----------
forward_kinematics = PythonScript(set_joint_positions=Button(), joint_positions=jp, a1=a1, a2=a2, a3=a3, a4=a4, a5=a5, a6=a6)  # -> full_configuration; inputs joint_positions: list
# ---------- forward_kinematics: Python ----------
import math
import Grasshopper
from compas.robots import Joint
from compas_fab.robots import Configuration

if set_joint_positions:

    j = 0
    for i in range(ghenv.Component.Params.Input.Count):
        nslider = ghenv.Component.Params.Input[i].Sources[0]
        if nslider.GetType() == Grasshopper.Kernel.Special.GH_NumberSlider:
            nslider.TrySetSliderValue(math.degrees(joint_positions[j]))
            j += 1

if robot:
    joint_positions = [a1, a2, a3, a4, a5, a6]
    joint_types = robot.get_configurable_joint_types()
    for i, joint_type in enumerate(joint_types):
        if joint_type == Joint.REVOLUTE:
            joint_positions[i] = math.radians(joint_positions[i])
    full_configuration = Configuration(joint_positions, joint_types)
    
print(full_configuration)
# ---------- end forward_kinematics ----------

# ----
plane_nr = Slider(-1, range=-1..20)

# ----
# Info
info = PythonScript(robot=robot)  # -> out, main_group_name
# ---------- info: Python ----------
if robot:
    robot.info()
    main_group_name = robot.main_group_name
# ---------- end info ----------
panel_3 = Panel(info.out)

pln_2 = Plane(Plane(origin=(-0.7542, -0.173498, 0.568652), x=(0, -1, 0), y=(-1, 0, 0)))

bang = Button()
panel_4 = Panel("Unload libraries")
unload = PythonScript(bang=bang)
# ---------- unload: Python ----------
from compas_rhino.utilities.misc import get_tolerance
from compas_rhino.utilities.misc import unload_modules

unload_modules("compas")
unload_modules("compas_fab")
unload_modules("ur_fabrication_control")
unload_modules("mobile_additive_manufacturing")
unload_modules("am_information_model")
# ---------- end unload ----------

# ---- group: Only needs to be created once
overwrite = Button()
create_2 = Button()
fabrication = GhPythonScript(create=create_2, overwrite=overwrite)  # -> out, fabrication
# ---------- fabrication: Python ----------
__author__ = "Gido"
__version__ = "2020.01.14"

from scriptcontext import sticky as st
from ur_fabrication_control.direct_control.fabrication_process import Fabrication

server_ip = st["server_address"]
server_port = st["server_port"]

fabrication_key = "fabrication"

if fabrication_key not in st:
    st[fabrication_key] = None

if overwrite and st[fabrication_key] != None:
    fabrication = st[fabrication_key]
    if hasattr(fabrication, 'task_thread') and hasattr(fabrication, 'listen_thread'):
        fabrication._join_threads()

if (create and st[fabrication_key] == None) or overwrite:
    fabrication = Fabrication()
    fabrication.set_feedback_server(server_ip, server_port)
    
    st[fabrication_key] = fabrication

fabrication = st[fabrication_key]
# ---------- end fabrication ----------

# ----
# Set Extruder data
acceleration = Slider(600, range=0..1000)
speed = Slider(2400, range=0..51200)
max_speed = Slider(4000, range=0..51200)
number = Slider(0, range=0..10)
value = BooleanToggle(True)
send = Button()
extruder_data = PythonScript(motor_id=number, motor_state=value, max_speed=max_speed, speed=speed, acceleration=acceleration, send=send)  # -> urscript; inputs motor_id: Int32, motor_state: Boolean
# ---------- extruder_data: Python ----------
import time
from scriptcontext import sticky as st
from mobile_additive_manufacturing.control.clay_extruder_control import ExtruderClient

ext_ip = st["ext_ip"]
ext_port = st["ext_port"]

ec = ExtruderClient(ext_ip, ext_port)
wait_for_response = False

if send:
    ec.connect()
    time.sleep(0.2)
    ec.send_motordata(motor_id, motor_state, max_speed, speed, acceleration, wait_for_response)
    time.sleep(0.2)
    ec.close()
# ---------- end extruder_data ----------

# ----
# Get Extruder Info
send_2 = Button()
get_info = PythonScript(send=send_2)  # -> info
# ---------- get_info: Python ----------
import time
from scriptcontext import sticky as st
from mobile_additive_manufacturing.control.clay_extruder_control import ExtruderClient

ext_ip = st["ext_ip"]
ext_port = st["ext_port"]

ec = ExtruderClient(ext_ip, ext_port)
wait_for_response = True

if send:
    ec.connect()
    time.sleep(0.2)
    info = ec.send_get_arduino_info(wait_for_response)
    time.sleep(0.2)
    ec.close()
# ---------- end get_info ----------

# ----
# Direct extruder control
panel_5 = Panel(get_info)

# ----
# Toggle Extruder
value_2 = BooleanToggle(True)
send_3 = Button()
extruder_state = PythonScript(state=value_2, send=send_3)  # -> urscript; inputs state: Boolean
# ---------- extruder_state: Python ----------
import time
from scriptcontext import sticky as st
from mobile_additive_manufacturing.control.clay_extruder_control import ExtruderClient

ext_ip = st["ext_ip"]
ext_port = st["ext_port"]

ec = ExtruderClient(ext_ip, ext_port)
wait_for_response = False

if send:
    ec.connect()
    time.sleep(0.2)
    ec.send_motorstate(0, int(state), wait_for_response)
    time.sleep(0.2)
    ec.close()
# ---------- end extruder_state ----------

# ----
# Stop Extruder
stop_2 = Button()
stop_3 = PythonScript(stop=stop_2)
# ---------- stop_3: Python ----------
import time
from scriptcontext import sticky as st
from mobile_additive_manufacturing.control.clay_extruder_control import ExtruderClient

ext_ip = st["ext_ip"]
ext_port = st["ext_port"]

ec = ExtruderClient(ext_ip, ext_port)
wait_for_response = False

if stop:
    ec.connect()
    time.sleep(0.2)
    ec.send_stop(wait_for_response)
    time.sleep(0.2)
    ec.close()
# ---------- end stop_3 ----------

# ----
# Set Extruder Digital Out
value_3 = BooleanToggle(True)
send_4 = Button()
list_6 = ValueList({"30", "32", "34"}, selected="30")
digital_out = PythonScript(pin=list_6, state=value_3, send=send_4)  # -> urscript; inputs pin: Int32, state: Boolean
# ---------- digital_out: Python ----------
import time
from scriptcontext import sticky as st
from mobile_additive_manufacturing.control.clay_extruder_control import ExtruderClient

ext_ip = st["ext_ip"]
ext_port = st["ext_port"]

ec = ExtruderClient(ext_ip, ext_port)
wait_for_response = False

if send:
    ec.connect()
    time.sleep(0.2)
    ec.send_set_do(pin, int(state), wait_for_response)
    time.sleep(0.2)
    ec.close()
# ---------- end digital_out ----------

# ----
# Toggle fan
value_4 = BooleanToggle(True)
send_5 = Button()
list_7 = ValueList({"30", "32", "34"}, selected="34")
digital_out_2 = PythonScript(pin=list_7, state=value_4, send=send_5)  # -> urscript; inputs pin: Int32, state: Boolean; same code as digital_out

# ----
# Toggle air
value_5 = BooleanToggle(False)
send_6 = Button()
list_8 = ValueList({"30", "32", "34"}, selected="32")
digital_out_3 = PythonScript(pin=list_8, state=value_5, send=send_6)  # -> urscript; inputs pin: Int32, state: Boolean; same code as digital_out

# ----
# Primitive version of slicing
number_slider_2 = Slider(0.006, range=0..0.01)
number_slider_3 = Slider(0.1, range=0..1)
multiplication_2 = Multiplication(A=height, B=number_slider_3)
division = Division(A=multiplication_2, B=number_slider_2)
series = Series(Start=0, Step=number_slider_2, Count=division)
X = UnitX(Factor=1)
Y = UnitY(Factor=1)
xy_3 = XYPlane(Origin=Point(0, 0, 0))

addition = Addition(A=pdecon.ZComponent, B=number_slider_2)
addition_2 = Addition(A=addition, B=number_slider)
Z_2 = UnitZ(Factor=series)

# ---- group: Visualise
# Visualization
# 1. Visualise the entire assembly.
# 2. Visualise the assembly process by setting a counter and a speed.
show_2 = BooleanToggle(False)
show_3 = BooleanToggle(True)

# ----
# am_information_model
number_slider_4 = Slider(0.001, range=0..1)

visualize = GhPythonScript(wall=wave.wall)  # -> out, rhmesh
# ---------- visualize: Python ----------
from compas_ghpython.artists import MeshArtist

# Mesh Artist for visualization
artist = MeshArtist(wall.mesh)
#vertices = artist.draw_vertices()
#edges = artist.draw_edges()
#faces = artist.draw_faces()
#labels = {key: key for key in mesh.vertices()}

rhmesh = artist.draw()
# ---------- end visualize ----------
mesh = Mesh(visualize.rhmesh)

# ----
# 2.
move2pt = MoveToPoint(Geometry=visualize.rhmesh, PointA=xy, PointB=pln)  # -> Moved, Vector, Transform
rotate = Rotate(Geometry=move2pt.Moved, Angle=pi, Plane=xy_2)  # -> Geometry, Transform

scale = Scale(Geometry=rotate.Geometry, Center=pln, Factor=number_slider_3)  # -> Geometry, Transform
pt = ConstructPoint(XCoordinate=0, YCoordinate=0, ZCoordinate=addition_2)
pl = ConstructPlane(Origin=pt, XAxis=X, YAxis=Y)

move = Move(Geometry=scale.Geometry, Motion=multiplication)  # -> Geometry, Transform

preview = CustomPreview(Geometry=move.Geometry, Material=ColourSwatch(SwatchColor=RGB(255, 125, 125)))

move_2 = Move(Geometry=move.Geometry, Motion=Z)  # -> Geometry, Transform

sec = MeshPlane(Mesh=move_2.Geometry, Plane=pl)  # -> flatten(Curves)

move_3 = Move(Geometry=sec, Motion=Z_2)  # -> Geometry, Transform

divide = DivideCurve(Curve=move_3.Geometry, Count=Slider(100, range=0..500), Kinks=False)  # -> Points, Tangents, Parameters
pline = PolyLine(Vertices=divide.Points, Closed=False)  # -> flatten(Polyline)

crv = Curve(flatten(pline))
generate_manufacturing_model = GhPythonScript(polylines=crv, start_node=xy_3, thickness=number_slider_2, radius=number_slider_4, alternate=Toggle(True))  # -> out, amim, nodes, edges; inputs polylines: list, start_node: Point3d
# ---------- generate_manufacturing_model: Python ----------
import rhinoscriptsyntax as rs
import Rhino.Geometry as rg
import math

from compas.geometry import Frame

from compas_ghpython import draw_frame

from am_information_model import AMIM
from am_information_model import Node
from am_information_model import Layer

def shift(seq, n):
    n = n % len(seq)
    return seq[n:] + seq[:n]

amim = AMIM()

for i, polyline in enumerate(polylines):
    crv_pts = rs.CurvePoints(polyline)
    nodes = []
    if i%2 == 1 and alternate:
        crv_pts.reverse()
    for i, pt in enumerate(crv_pts):
        node_pt = rg.Point3d(pt)
        node_frame = Frame(node_pt, (0,-1,0), (-1,0,0))
        if i != 0 and i != len(crv_pts)-1:
            node = Node(node_frame, radius)
        else:
            node = Node(node_frame, thickness/3)
        nodes.append(node)
    layer = Layer.from_nodes(nodes)
    amim.add_layer(layer)


nodes = []
edges = []

for pt in amim.network.to_points():
    nodes.append(rs.AddPoint(pt))

for tup in amim.network.to_lines():
    edges.append(rs.AddLine(tup[0],tup[1]))
# ---------- end generate_manufacturing_model ----------
amim = Data(generate_manufacturing_model.amim)
crv_2 = Curve(crv)
join = JoinCurves(Curves=crv_2, Preserve=False)
fillet = Fillet(Curve=join, Radius=number_slider_4)

# ---- group: Visualise (continued)
counter = CountThroughList(amim=amim, start=start, stop=stop, step=step, step_back=back, reset=reset, full=full, interval=list)  # -> item, counter; inputs start: Boolean, stop: Boolean, step_back: Boolean
# ---------- counter: Python ----------
from scriptcontext import sticky as st
from compas_ghpython import update_component


L = list(amim.layers())
# store data in component
guid = str(ghenv.Component.InstanceGuid)
counter_key = "counter_" + guid
running_key = "running_" + guid

if counter_key not in st:
    st[counter_key] = 0

if running_key not in st:
    st[running_key] = False
    

if st[running_key]:
    if st[counter_key] < len(L) - 1:
        st[counter_key] += 1
        update_component(ghenv, interval)
    else:
        st[counter_key] = 0
        st[running_key] = False
    
    
if start:
    st[running_key] = True

if stop:
    st[running_key] = False

if step:
    if st[counter_key] < len(L) - 1:
        st[counter_key] += 1

if step_back:
    if st[counter_key] < len(L) - 1:
        st[counter_key] -= 1

if reset:
    st[counter_key] = 0

if full:
    st[counter_key] = len(L)-1

if len(L):
    item = L[st[counter_key]]



#st["visualisation_counter"] = st[counter_key]
counter = st[counter_key]
# ---------- end counter ----------
idx = Panel(counter.counter)
draw = PythonScript(amim=amim, show_all=show_2, show_counter=show_3, counter=idx)  # -> G, tool_planes_WCS, current_tool_plane, current_layer_planes; inputs counter: Int32
# ---------- draw: Python ----------
import os
import sys

import math

from compas_ghpython.artists import MeshArtist
from compas_ghpython import draw_frame

#from assembly_information_model.artist import AssemblyArtist


G = []

key_index = amim.network.key_index()
keys = [key_index[key] for key in amim.network.nodes()]
layers = [amim.layer(key) for key in keys] 

tool_planes_WCS = [draw_frame(layer.start_node.frame) for layer in layers]

current_tool_plane = tool_planes_WCS[counter]
current_layer_planes = [draw_frame(frame) for frame in layers[counter].path]

if show_all and not show_counter:
    for layer in layers:
        for node in layer.nodes:
            plane = draw_frame(node.frame)
            G.append(plane)

if show_counter:
    for layer in layers[0:counter+1]:
        for node in layer.nodes:
            plane = draw_frame(node.frame)
            G.append(plane)
# ---------- end draw ----------
geo = Geometry(draw.G)
pln_3 = Plane(draw.current_tool_plane)
pln_4 = Plane(draw.tool_planes_WCS)
pln_5 = Plane(draw.current_layer_planes)
preview_2 = CustomPreview(Geometry=geo, Shader=ColourSwatch(SwatchColor=RGBA(255, 186, 220, 146)))

# ---- group: inverse kinematics
select_configuration = Slider(0, range=0..7)
inverse = PythonScript(robot=robot, planes_WCS=pln_5, plane_nr=plane_nr, idx=select_configuration)  # -> out, plane_tool0_RCS, plane_tcp_RCS, configuration; inputs planes_WCS: list of Plane, plane_nr: Int32, idx: Int32
# ---------- inverse: Python ----------
import Rhino.Geometry as rg
import math
from compas.geometry import Frame, Transformation, Rotation
from compas_fab.robots import Configuration
from ur_fabrication_control.kinematics.ur_kinematics import inverse_kinematics
from ur_fabrication_control.kinematics.ur_params import ur_params
from compas_ghpython import draw_frame

plane_WCS = planes_WCS[plane_nr]

tcp_WCS = Frame(plane_WCS.Origin, plane_WCS.XAxis, plane_WCS.YAxis)

# transform frame to robot coordinate system
tcp_RCS = robot.to_local_coordinates(tcp_WCS)
tool0_RCS = robot.from_tcf_to_t0cf([tcp_RCS])[0]

print tcp_RCS
print tool0_RCS
plane_tool0_RCS = draw_frame(tool0_RCS)
plane_tcp_RCS = draw_frame(tcp_RCS)
# calculate solutions to frame
ur_params = ur_params[robot.name] # get the parameters according to the robot model
solutions = inverse_kinematics(tool0_RCS, ur_params)

if not len(solutions):
    joint_values = [0,0,0,0,0,0]
    configuration = Configuration.from_revolute_values(joint_values)
else:
    joint_values = solutions[idx]
    #print joint_values
    
    ### ***** HACK ***** ##### TODO: CHECK!!!
    for i, v in enumerate(joint_values):
        if v > math.pi:
            v -= 2*math.pi
        if v < -math.pi:
            v += 2*math.pi
        joint_values[i] = v
    ### ***** HACK ***** ##### TODO: CHECK!!!
    
    configuration = [Configuration.from_revolute_values(joint_values)]

print(configuration)
# ---------- end inverse ----------

select_configuration_2 = Slider(0, range=0..7)
inverse_2 = PythonScript(robot=robot, plane_WCS=pln_3, idx=select_configuration_2)  # -> out, plane_tool0_RCS, plane_tcp_RCS, configuration; inputs plane_WCS: Plane, idx: Int32
# ---------- inverse_2: Python ----------
import Rhino.Geometry as rg
import math
from compas.geometry import Frame, Transformation, Rotation
from compas_fab.robots import Configuration
from ur_fabrication_control.kinematics.ur_kinematics import inverse_kinematics
from ur_fabrication_control.kinematics.ur_params import ur_params
from compas_ghpython import draw_frame

tcp_WCS = Frame(plane_WCS.Origin, plane_WCS.XAxis, plane_WCS.YAxis)

# transform frame to robot coordinate system
print tcp_WCS
print plane_WCS
tcp_RCS = robot.to_local_coordinates(tcp_WCS)
tool0_RCS = robot.from_tcf_to_t0cf([tcp_RCS])[0]
tool0_RCS_rot = Frame(tool0_RCS.point, tool0_RCS.zaxis, tool0_RCS.yaxis)
print tcp_RCS
print tool0_RCS
plane_tool0_RCS = draw_frame(tool0_RCS)
plane_tcp_RCS = draw_frame(tcp_RCS)
# calculate solutions to frame
ur_params = ur_params[robot.name] # get the parameters according to the robot model
print ur_params
solutions = inverse_kinematics(tool0_RCS, ur_params)
print solutions

if not len(solutions):
    joint_values = [0,0,0,0,0,0]
    configuration = Configuration.from_revolute_values(joint_values)
else:
    joint_values = solutions[idx]
    #print joint_values
    
    ### ***** HACK ***** ##### TODO: CHECK!!!
    for i, v in enumerate(joint_values):
        if v > math.pi:
            v -= 2*math.pi
        if v < -math.pi:
            v += 2*math.pi
        joint_values[i] = v
    ### ***** HACK ***** ##### TODO: CHECK!!!
    configuration = [Configuration.from_revolute_values(joint_values)]

print(configuration)
# ---------- end inverse_2 ----------

# ----
# Move Cartesian
add = Button()
list_9 = ValueList({"send all positions": 0, "send only one position": 1, "from inverse": 2}, selected="from inverse")
clear = Button()
idx_2 = Slider(0, range=0..100)
crv_3 = Curve(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)
hframes = HorizontalFrames(Curve=crv_3, Count=10)  # -> Frames, Parameters
rec_car = PythonScript(rec=add, clear=clear)  # -> rec
# ---------- rec_car: Python ----------
from scriptcontext import sticky as st

guid = str(ghenv.Component.InstanceGuid)
recorded_key =  "recorded_" + guid
just_cleared_key = "just_cleared_" + guid


if recorded_key not in st:
    st[recorded_key] = []

if just_cleared_key not in st:
    st[just_cleared_key] = False

if clear:
    st[recorded_key] = []
    st[just_cleared_key] = True
else:
    if len(msg):
        if msg != [None] and not st[just_cleared_key] and rec:
            st[recorded_key].append(msg)
    st[just_cleared_key] = False
        


rec = st[recorded_key]

print rec
# ---------- end rec_car ----------
item = ListItem(List=hframes.Frames, Index=idx_2, Wrap=True)
filter = StreamFilter(Gate=list_9, Stream0=hframes.Frames, Stream1=item, Stream2=rec_car)
radius = Slider(0.5, range=0..0.5)
movel = PythonScript(planes_WCS=inverse.plane_tcp_RCS, velocity=Slider(0.075, range=0..0.5), radius=radius)  # -> urscript; inputs planes_WCS: list
# ---------- movel: Python ----------
import Rhino.Geometry as rg
from compas.geometry import Frame
from compas.geometry import Transformation, Rotation
from compas_ghpython import draw_frame
from compas_fab.robots import robot
from ur_fabrication_control import direct_control 
import math

from scriptcontext import sticky as st
from ur_fabrication_control.direct_control import URScript

robot = st["robot"]

# retrieve the current tool frame in axis angle format
if robot.attached_tool:
    tool_angle_axis = list(robot.attached_tool.frame.point) + list(robot.attached_tool.frame.axis_angle_vector)
else:
    tool0_frame = Frame([0, 0, 0], [1, 0, 0], [0, 1, 0])
    tool_angle_axis = list(tool0_frame.point) + list(tool0_frame.axis_angle_vector)

frames_RCS = []
for plane_WCS in planes_WCS:
    frame_WCS = Frame(plane_WCS.Origin, plane_WCS.XAxis, plane_WCS.YAxis)
    frame_RCS = robot.to_local_coordinates(frame_WCS)
    frames_RCS.append(frame_RCS)

urscript = URScript()
urscript.start()
urscript.moves_linear(frames_RCS, velocity, radius)
urscript.end()

urscript = urscript.generate()

print(urscript)
# ---------- end movel ----------
send_7 = Button()
send_8 = GhPythonScript(urscript=movel, send=send_7)  # -> out; inputs send: Boolean
# ---------- send_8: Python ----------
from scriptcontext import sticky as st
from ur_fabrication_control.direct_control import send_script

ur_ip = st["ur_ip"]
ur_port = st["ur_port"]

if send:
    send_script(urscript, ur_ip, ur_port)
# ---------- end send_8 ----------

list_10 = ValueList({"0 forward_kinematics": 0, "1 inverse_kinematics": 1, "2 inverse_kinematics": 2}, selected="2 inverse_kinematics")
filter_2 = StreamFilter(Gate=list_10, Stream0=forward_kinematics, Stream1=inverse_2.configuration, Stream2=inverse.configuration)

# ----
# Fabrication
ext_speed = Slider(2800, range=0..4000)
ext_accel = Slider(200, range=0..1000)
ur_speed = Slider(0.014, range=0..1)
include_extruder = BooleanToggle(True)
Z_3 = UnitZ(Factor=Slider(0.6, range=0..1))
create_tasks = Button()
send_data = Button()
start_2 = Button()
stop_4 = Button()
move_4 = Move(Geometry=pln, Motion=Z_3)  # -> Geometry, Transform
timer = Timer(TimerInterval=1000, Target=continuous_operation_multiple_layers)
continuous_operation_multiple_layers = GhPythonScript(
    fabrication=fabrication.fabrication,
    amim=amim,
    robot=robot,
    safety_plane=move_4.Geometry,
    ur_speed=ur_speed,
    ext_speed=ext_speed,
    ext_accel=ext_accel,
    create_tasks=create_tasks,
    send_extruder_data=send_data,
    include_extruder=include_extruder,
    start=start_2,
    stop=stop_4)  # -> out, msgs, states, tasks, exit_msgs, current_task, fabrication
# ---------- continuous_operation_multiple_layers: Python ----------
from scriptcontext import sticky as st

from compas.geometry import Frame
from compas.geometry import Translation
from compas.geometry import Vector
from compas_ghpython import update_component
from mobile_additive_manufacturing.control import URScript_Extrusion
from ur_fabrication_control.direct_control.fabrication_process import Fabrication

ur_ip = st["ur_ip"]
ur_port = st["ur_port"]
server_ip = st["server_address"]
server_port = st["server_port"]
ext_ip = st["ext_ip"]
ext_port = st["ext_port"]

def create_tasks_from_amim(amim):
    for key, layer in amim.layers():
        if key == 0:
            toggle_extruder = True
        elif key == amim.number_of_layers()-1:
            toggle_extruder = False
        else:
            toggle_extruder = None
        exit_message = "Layer{}_completed".format(key)
        layer_urscript = get_layer_ur_script(layer, toggle_extruder, exit_message)
        fabrication.add_task(layer_urscript, exit_message)

def get_frames_in_RCS(frames):
    return [robot.to_local_coordinates(frame) for frame in frames]

def get_layer_ur_script(layer, toggle_extruder, exit_message):
    ur_script = URScript_Extrusion(ur_ip=ur_ip, ur_port=ur_port, ext_ip=ext_ip, ext_port=ext_port)
    tool_angle_axis = list(robot.attached_tool.frame.point) + list(robot.attached_tool.frame.axis_angle_vector)
    
    ur_script.start()
    ur_script.set_tcp(tool_angle_axis)
    RCS_frames = get_frames_in_RCS([node.frame for node in layer.nodes])
    first = False
    for node in layer.nodes:
        if not first:
            ur_script.move_linear(robot.to_local_coordinates(node.frame), velocity=ur_speed, radius=node.radius)
            first = True
            if (toggle_extruder == True) and (toggle_extruder != None) and include_extruder:
                toggle_extrusion(ur_script, int(toggle_extruder))
        else:
            ur_script.move_process(robot.to_local_coordinates(node.frame), ur_speed, node.radius)
    else:
        if (toggle_extruder == False) and (toggle_extruder != None) and include_extruder:
            toggle_extrusion(ur_script, int(toggle_extruder))
    # Signify ready
    ur_script.socket_open(server_ip, server_port, "Feedbackserver")
    ur_script.socket_send_line_string(exit_message, socket_name="Feedbackserver")
    ur_script.socket_close(name="Feedbackserver")
    #Finalize script
    ur_script.end()
    ur_script.generate()
    return ur_script

def get_stop_ur_script(safety_plane):
    safety_frame_WCS = Frame(safety_plane.Origin, safety_plane.XAxis, safety_plane.YAxis)
    safety_frame_RCS = robot.to_local_coordinates(safety_frame_WCS)
    
    ur_script = URScript_Extrusion(ur_ip=ur_ip, ur_port=ur_port, ext_ip=ext_ip, ext_port=ext_port)
    tool_angle_axis = list(robot.attached_tool.frame.point) + list(robot.attached_tool.frame.axis_angle_vector)
    
    ur_script.start()
    ur_script.set_tcp(tool_angle_axis)
    if include_extruder:
        toggle_extrusion(ur_script, 0)
    ur_script.move_linear(safety_frame_RCS, velocity=ur_speed, radius=0)
    ur_script.end()
    ur_script.generate()
    return ur_script

def set_extruder_data(speed, acceleration, id):
    ur_script = URScript_Extrusion(ur_ip=ur_ip, ur_port=ur_port, ext_ip=ext_ip, ext_port=ext_port)
    ur_script.start()
    ur_script.open_socket_extruder()
    ur_script.set_extruder_data(speed=ext_speed, acceleration=ext_accel)
    ur_script.close_socket_extruder()
    ur_script.socket_open(server_ip, server_port, "Feedbackserver")
    ur_script.socket_send_line_string("Set_extruder_data{}".format(id), socket_name="Feedbackserver")
    ur_script.socket_close(name="Feedbackserver")
    ur_script.end()
    ur_script.generate()
    return ur_script

def toggle_extrusion(ur_script, state):
    ur_script.open_socket_extruder()
    if state==1:
        ur_script.toggle_fan(state=state)
    ur_script.toggle_air(state=state)
    ur_script.toggle_drv8825(state=state)
    ur_script.add_line('\tsleep(1)')
    ur_script.toggle_extruder(state=state)
    ur_script.close_socket_extruder()

if create_tasks:
    fabrication.clear_tasks()
    fabrication.stop_task = get_stop_ur_script(safety_plane)
    if include_extruder:
        fabrication.add_task(set_extruder_data(ext_speed, ext_accel, 0), "Set_extruder_data0")
    create_tasks_from_amim(amim)

if send_extruder_data:
    ext_data = set_extruder_data(ext_speed, ext_accel)
    ext_data.send_script()

if stop:
    fabrication.stop()

if start:
    fabrication.start()

try:
    fab = fabrication
except NameError:
    fabrication = None
else:
    task_dict = fabrication.tasks.values()
    if fabrication.tasks_available():
        if fabrication.current_task == None:
            task_key_current = fabrication.get_next_task()
        else:
            task_key_current = fabrication.current_task
        current_task = task_dict[task_key_current]["task"].script
    tasks = []
    states = []
    exit_msgs = []
    for task in task_dict:
        tasks.append(task["task"])
        states.append(task["state"])
        exit_msgs.append(task["exit_message"])
    msgs = fabrication.server.msgs.values()
# ---------- end continuous_operation_multiple_layers ----------
server_messages = Panel(continuous_operation_multiple_layers.msgs)
states = Panel(continuous_operation_multiple_layers.states)
current_task = Panel(continuous_operation_multiple_layers.current_task)
tasks = Panel(continuous_operation_multiple_layers.tasks)
exit_message = Panel(continuous_operation_multiple_layers.exit_msgs)

# ----
# Visualisation
show_end_effector_frame = BooleanToggle(True)
show_base_frame = BooleanToggle(False)
show_collision = BooleanToggle(False)
show_frames = BooleanToggle(False)
show_visual = BooleanToggle(True)
show_acm = BooleanToggle(False)
visualize_2 = PythonScript(
    robot=robot,
    tool=python.tool,
    group=info.main_group_name,
    configuration=filter_2,
    show_visual=show_visual,
    show_collision=show_collision,
    show_end_effector_frame=show_end_effector_frame,
    show_frames=show_frames,
    show_base_frame=show_base_frame,
    show_acm=show_acm)  # -> out, robot, visual, collision, attached_meshes, frames, ee_frame, tool0_frame, base_frame; inputs redraw: list, attached_collision_meshes: list
# ---------- visualize_2: Python ----------
from compas.geometry import Vector
from compas.geometry import Point
from compas.geometry import Transformation
from compas.geometry import Frame
from compas_ghpython.artists import MeshArtist
from compas_fab.robots import Configuration
from ur_fabrication_control.kinematics.ur_kinematics import forward_kinematics
from ur_fabrication_control.kinematics.ur_params import ur_params

print(configuration)

if robot and configuration:
    
    robot.update(configuration, visual=show_visual, collision=show_collision)
    ur_params = ur_params[robot.name]
    
    if show_visual:
        visual = robot.artist.draw_visual()

    if show_collision:
        collision = robot.artist.draw_collision()
    
    frames = robot.transformed_frames(configuration, group)

    if show_base_frame:
        base_frame = frames[0]

    if show_end_effector_frame:
        tool0_frame = forward_kinematics(configuration.revolute_values, ur_params)
#        tool0_frame = robot.forward_kinematics(configuration, group)
        print tool0_frame
        ee_frame = robot.from_t0cf_to_tcf([tool0_frame])
        print("End-effector", ee_frame)
    
    if not show_frames:
        frames = None

    frame = forward_kinematics(configuration.revolute_values, ur_params)
#    frame = robot.forward_kinematics(configuration, options=dict(solver='model', link_name=robot.attached_tool.link_name))
    robot.artist.update_tool(visual=visual, collision=collision, transformation=Transformation.from_frame_to_frame(Frame.worldXY(), tool0_frame))
    
    if show_acm:
        M = []
        for acm in attached_collision_meshes:
            frame = robot.forward_kinematics(configuration, options=dict(solver='model', link_name=acm.link_name))
            T = Transformation.from_frame_to_frame(Frame.worldXY(), frame)
            mesh = acm.collision_mesh.mesh.transformed(T)
            M.append(MeshArtist(mesh).draw())
        attached_meshes = M
# ---------- end visualize_2 ----------
geo_2 = Geometry(visualize_2.visual)
geo_3 = Geometry(visualize_2.collision)
draw_2 = GhPythonScript(
    frames=[visualize_2.frames, visualize_2.ee_frame, visualize_2.base_frame, visualize_2.tool0_frame],
    scale=Slider(0.1, range=0..1))  # -> P, V, C, W; inputs frames: list
# ---------- draw_2: Python ----------
from System.Drawing import Color
from compas_ghpython.utilities import draw_frame

red = Color.FromArgb(255, 0, 0)
green = Color.FromArgb(0, 255, 0)
blue = Color.FromArgb(0, 0, 255)

P = []
V = []
C = []

scale = float(scale)

for frame in frames:
    if not frame:
        continue
    plane = draw_frame(frame)
    P += [plane.Origin] * 3
    V.append(plane.XAxis * scale)
    V.append(plane.YAxis * scale)
    V.append(plane.ZAxis * scale)
    C += [red, green, blue]

W = 3
# ---------- end draw_2 ----------
vdisex = VectorDisplayEx(Point=draw_2.P, Vector=draw_2.V, Colour=draw_2.C, Width=draw_2.W)
preview_3 = CustomPreview(Geometry=geo_2, Shader=ColourSwatch(SwatchColor=RGB(105, 105, 105)))
preview_4 = CustomPreview(Geometry=visualize_2.attached_meshes, Shader=ColourSwatch(SwatchColor=RGB(255, 255, 255)))
