# Grasshopper definition window_in_wall_interactive2.ghx (Grasshopper 1.0.7)
# plug-ins: Weaverbird, karambaGH

number_slider = Slider(2.4, range=1..3)
number_slider_2 = Slider(1.2, range=0..2)

# ----
# Doubleclick Me!
reload = Button()
py = PythonScript(reload=reload)
# ---------- py: Python ----------
from compas_rhino.utilities.misc import get_tolerance
from compas_rhino.utilities.misc import unload_modules

from compas_ghpython import unload_modules

unload_modules("compas")
unload_modules("compas_fab")
unload_modules("ur_fabrication_control")
unload_modules("assembly_information_model")
unload_modules("am_information_model") 
unload_modules("window_in_wall")
# ---------- end py ----------
py_2 = PythonScript()  # -> HERE, DATA
# ---------- py_2: Python ----------
import os

HERE = os.path.dirname(ghdoc.Path)
DATA = os.path.abspath(os.path.join(HERE, "..", "data"))

#print(HERE)
#print(DATA)
# ---------- end py_2 ----------

list = ValueList({"circular", "persian", "interactive"}, selected="interactive")
toggle = BooleanToggle(True)

width = Number(4.8)
height = Number(3.3)
elsize = Number(0.02)
create_wall = GhPythonScript(init=Button(), width=width, height=height, elsize=elsize)  # -> wall
# ---------- create_wall: Python ----------
from window_in_wall import Wall


# create wall
wall = Wall()


# construct COMPAS quad mesh from width and height
wall.create_quad_mesh_from_dimensions(width, height, elsize)
# ---------- end create_wall ----------

make_gate_analytical = GhPythonScript(wall=create_wall, make_gate=toggle, gate_type=list, gate_x=number_slider, gate_size=number_slider_2)  # -> out, wall
# ---------- make_gate_analytical: Python ----------
if make_gate:
    wall.make_gate(gate_size, gate_x, gate_type)
# ---------- end make_gate_analytical ----------
make_gate_interactive = GhPythonScript(wall=create_wall, make_gate=toggle, gate_type=list, gate_x=number_slider, gate_size=number_slider_2)  # -> out, wall; inputs gate: Curve
# ---------- make_gate_interactive: Python ----------
import math
import compas
import Rhino as rh
import ghpythonlib as gh
from compas.datastructures import Mesh


for vertex in wall.mesh.vertices():
    # get x and z coordinates from vertex
    x_val = wall.mesh.vertex_attribute(vertex, name='x')
    z_val = wall.mesh.vertex_attribute(vertex, name='z')

    # calculate distance
    gate_rel_x = gate_x-x_val
    gate_rel_z = z_val

    #in order to avoid division by zero. should be cleaned up ASAP
    if gate_rel_x==0:
        gate_rel_x=0.000000001

    #this boolean will be set to True if vertex lies inside the gate 
    in_gate_vertex = False

    #for each gate tpye, the a corresponding function is called to check
    # to check if vertex lies inside the gate
    if gate_type=="circular":
        if wall.in_gate_circular(gate_size, gate_rel_x,gate_rel_z):
            in_gate_vertex = True
    if gate_type=="persian":
        if wall.in_gate_persian(gate_size, gate_rel_x,gate_rel_z):
            in_gate_vertex = True
    if gate_type=="interactive":
        point = rh.Geometry.Point3d( wall.mesh.vertex_attribute(vertex, name='x'), 0, wall.mesh.vertex_attribute(vertex, name='z') )
        pointInGate = gh.components.PointInCurve(point,gate).relationship
        if pointInGate == 2: in_gate_vertex = True

    if in_gate_vertex:
        # store new vertex attribute with the distance to the gate center
        wall.mesh.vertex_attribute(vertex,"x_disp", value=-gate_rel_x)
        wall.mesh.vertex_attribute(vertex,"z_disp", value=gate_rel_z)
        #in_gate flag indicates that this vertex lies in the gate
        wall.mesh.vertex_attribute(vertex,"in_gate", value=True)
        wall.gate_points.append(vertex)
# ---------- end make_gate_interactive ----------

list_2 = ValueList({"1:10": 0.1, "1:5": 0.2}, selected="1:10")
python = GhPythonScript(scalefactor=list_2)  # -> out, div_length
# ---------- python: Python ----------
div_length = 0.0045 / scalefactor

print (div_length)
# ---------- end python ----------
crv_gate_right = Curve(<curve referenced from the Rhino model>)
crv_wall_right = Curve(<curve referenced from the Rhino model>)
crv_gate_top = Curve(<curve referenced from the Rhino model>)
crv_gate_left = Curve(<curve referenced from the Rhino model>)
crv_wall_left = Curve(<curve referenced from the Rhino model>)
print_path_generation = GhPythonScript(
    div_length=python.div_length,
    angle_constraint="35",
    crv_gate_left=crv_gate_left,
    crv_wall_left=crv_wall_left,
    crv_gate_right=crv_gate_right,
    crv_wall_right=crv_wall_right,
    crv_gate_top=crv_gate_top,
    blend_layers="20")  # -> out, pts_gate_left, pts_wall_left, pts_gate_right, pts_wall_right, crvs_region_left, crvs_region_right, crvs_region_left_top, crvs_region_right_top, crvs_region_top; inputs crv_gate_left: Curve, crv_wall_left: Curve, crv_gate_right: Curve, crv_wall_right: Curve, crv_gate_top: Curve, blend_layers: Int32
# ---------- print_path_generation: Python ----------
import Rhino.Geometry as rg
import ghpythonlib.components as ghcomp
import math



# planes gate left
tsl = crv_gate_left.DivideByLength(div_length, True)
div_count = len(tsl)
tsc = crv_gate_left.DivideByCount(div_count, True)
planes_gate_left = [crv_gate_left.PerpendicularFrameAt(t)[1] for t in tsc]

# planes gate right
tsc = crv_gate_right.DivideByCount(len(tsl), True)
planes_gate_right = [crv_gate_right.PerpendicularFrameAt(t)[1] for t in tsc]

# planes wall left
tsl = crv_wall_left.DivideByLength(div_length, True)
planes_wall_left = [crv_wall_left.PerpendicularFrameAt(t)[1] for t in tsl]

# planes wall right
tsl = crv_wall_right.DivideByLength(div_length, True)
planes_wall_right = [crv_wall_right.PerpendicularFrameAt(t)[1] for t in tsl]

planes_wall_left_top = planes_wall_left[len(planes_gate_left):]
planes_wall_right_top = planes_wall_right[len(planes_gate_left):]

# planes gate top
tsc = crv_gate_top.DivideByCount(len(planes_wall_right_top), False)
planes_gate_top = [crv_gate_top.PerpendicularFrameAt(t)[1] for t in tsc]


def blend_cosine(value, count=len(planes_gate_left)):
    step = (2*math.pi/count)*value
    #if value>blend_layers and value<(count-blend_layers):
    #    step = math.pi
    blendfactor = (math.cos(math.pi+step)+1)/2
    return blendfactor

def blend_linear(value, count=len(planes_gate_top)):
    blendfactor = (1/count)*value
    return blendfactor

blend_type = {
    "linear" : blend_linear,
    "cosine" : blend_cosine
}

def blend_function(value, func_type):
    return blend_type[func_type](value)

def generate_crvs(planes_gate, planes_wall, region="left"):
    
    if region=="left":
        mult=-1
        b_func = "cosine"
        tangent_start_min = mult*rg.Vector3d(1,0,0)
        tangent_start_max = mult*rg.Vector3d(1,0,0)
        tangent_start_max.Rotate(math.radians(-mult*angle_constraint), rg.Vector3d.YAxis)
    elif region=="right":
        mult=1
        b_func = "cosine"
        tangent_start_min = mult*rg.Vector3d(1,0,0)
        tangent_start_max = mult*rg.Vector3d(1,0,0)
        tangent_start_max.Rotate(math.radians(-mult*angle_constraint), rg.Vector3d.YAxis)
    elif region=="topleft":
        mult=-1
        b_func = "linear"
        tangent_start_max = mult*rg.Vector3d(1,0,0)
        tangent_start_min = mult*rg.Vector3d(1,0,0)
        tangent_start_min.Rotate(math.radians(-mult*angle_constraint), rg.Vector3d.YAxis)
    elif region=="topright":
        mult=1
        b_func = "linear"
        tangent_start_max = mult*rg.Vector3d(1,0,0)
        tangent_start_min = mult*rg.Vector3d(1,0,0)
        tangent_start_min.Rotate(math.radians(-mult*angle_constraint), rg.Vector3d.YAxis)
        
    crvs = []
    
    for i in range(len(planes_gate)):
        plane_gate = planes_gate[i]
        plane_wall = planes_wall[i]
        
        vertices = [plane_gate.Origin, plane_wall.Origin]
        
        normal = mult*plane_gate.XAxis
        
        if region!="topleft" and region!="topright":
            if i<len(planes_gate)/2:
                tangent_start = blend_function(i, b_func)*normal + (1-blend_function(i, b_func))*tangent_start_min
            else:
                tangent_start = blend_function(i, b_func)*normal + (1-blend_function(i, b_func))*tangent_start_max
            
        else:
            tangent_start = blend_function(i, b_func)*normal + (1-blend_function(i, b_func))*tangent_start_min
        
        tangent_end = mult*plane_wall.XAxis
        c, c_len, c_domain = ghcomp.Interpolatet(vertices, tangent_start, tangent_end, knotstyle=0)
        crvs.append(c)

    return crvs

crvs_region_left = generate_crvs(planes_gate_left, planes_wall_left, region="left")
crvs_region_right = generate_crvs(planes_gate_right, planes_wall_right, region="right")



crvs_region_left_top = generate_crvs(planes_gate_top, planes_wall_left_top, region="topleft")
crvs_region_right_top = generate_crvs(planes_gate_top, planes_wall_right_top, region="topright")

crvs_region_top = []
for i in range(len(crvs_region_left_top)):
    crvs = [crvs_region_left_top[i], crvs_region_right_top[i]]
    
    crv_joined = ghcomp.JoinCurves(crvs, False)
    crvs_region_top.append(crv_joined)
# ---------- end print_path_generation ----------
pt = Point(print_path_generation.pts_gate_left)
pt_2 = Point(print_path_generation.pts_gate_right)
crv = Curve(print_path_generation.crvs_region_right)
crv_2 = Curve(print_path_generation.crvs_region_left_top)
crv_3 = Curve(print_path_generation.crvs_region_right_top)
pt_3 = Point(print_path_generation.pts_wall_left)
pt_4 = Point(print_path_generation.pts_wall_right)
crv_4 = Curve(print_path_generation.crvs_region_left)
crv_5 = Curve(print_path_generation.crvs_region_top)

displacement = GhPythonScript(wall=make_gate_interactive.wall, comp_displ=toggle)  # -> out, wall
# ---------- displacement: Python ----------
from compas.rpc import Proxy

if comp_displ:
    #wall_methods_numpy = Proxy('window_in_wall.wall_methods_numpy')
    wall_methods_pde = Proxy('window_in_wall.wall_methods_pde')
    #wall_methods_numpy.stop_server() #if changes need to be reloaded
    #wall_methods_numpy.start_server()
    
    # compute displacement
    #solX, solZ = wall_methods_numpy.compute_displacement(wall.mesh,wall.gate_points, wall.x_size, wall.z_size)
    solX = wall_methods_pde.compute_displacement_x(wall.mesh,wall.gate_points, wall.x_size, wall.z_size)
    solZ = wall_methods_pde.compute_displacement_z(wall.mesh,wall.gate_points, wall.x_size, wall.z_size)
    
    # update vertex attributes with displacement values
    for v, data in wall.mesh.vertices(data=True):        
        wall.mesh.vertex_attribute(v, "x_disp", value=solX[v]) #value=solX[n_from_ij(i,j, wall.z_size)]
        wall.mesh.vertex_attribute(v, "z_disp", value=solZ[v]) #value=solZ[n_from_ij(i,j, wall.z_size)]
    
    # displace the vertices (for preview only)
    # wall.displace_vertices()
    #solmat = np.reshape(solX, (-1, n))
# ---------- end displacement ----------

up_phase = Slider(0.12, range=0..3)
up_freq = Slider(1, range=1..3)
up_amp = Slider(0, range=0..0.1)
down_freq = Slider(2.4, range=1..3)
down_amp = Slider(0.1, range=0..0.1)
wave = GhPythonScript(
    wall=displacement.wall,
    wave=Toggle(True),
    up_amp=up_amp,
    up_freq=up_freq,
    up_phase=up_phase,
    down_amp=down_amp,
    down_freq=down_freq,
    down_phase=up_phase)  # -> out, wall; inputs wave: Boolean
# ---------- wave: Python ----------
if wave:
    #wall.undulate(amp, freq, phase)
    #wall.undulate(up_amp, up_freq, up_phase, down_amp, down_freq, down_phase)
    wall.undulate_with_displ(up_amp, up_freq, up_phase, down_amp, down_freq, down_phase)
    #wall.undulate_with_displ(amp, freq, phase)
# ---------- end wave ----------

# ---- group: vector field
vector_size = Slider(0.219, range=0..0.5)
minus_one = Number(-1)
eps = Number(1e-07)
pow = Power(A=vector_size, B=minus_one)
vector_size_2 = Slider(0.655, range=0..1)

# ----
visualize = GhPythonScript(wall=wave.wall)  # -> out, rhmesh, vertices, points, x_disp, z_disp
# ---------- visualize: Python ----------
from compas_ghpython.artists import MeshArtist

# Mesh Artist for visualization
artist = MeshArtist(wall.mesh)
#vertices = artist.draw_vertices()
#edges = artist.draw_edges()
#faces = artist.draw_faces()
#labels = {key: key for key in mesh.vertices()}

rhmesh = artist.draw()


# draw gate points
v = []
for vertex in wall.mesh.vertices():
    gp = wall.mesh.vertex_attribute(vertex, name='in_gate')
    if gp: v.append(vertex)

if len(v): vertices = artist.draw_vertices(vertices=v)

x_disp = []
z_disp = []
for vertex in wall.mesh.vertices():
    x_disp.append(wall.mesh.vertex_attribute(vertex, name='x_disp'))
    z_disp.append(wall.mesh.vertex_attribute(vertex, name='z_disp'))
    

p = []
for vertex in wall.mesh.vertices():
    if gp: v.append(vertex)

if len(v): points = artist.draw_vertices(vertices=p)
# ---------- end visualize ----------
pt_5 = Point(visualize.vertices)
mesh = Mesh(visualize.rhmesh)
preview = CustomPreview(Geometry=pt_5, Material=ColourSwatch(SwatchColor=RGB(255, 184, 184)))

pt_6 = Point(visualize.points)

# ---- group: vector field (continued)
vec = VectorXYZ(XComponent=visualize.x_disp, YComponent=0, ZComponent=visualize.z_disp)  # -> Vector, Length
avoid_zero = Addition(A=vec.Length, B=eps)
scale_to_size = Multiplication(A=avoid_zero, B=pow)
normalize = Division(A=visualize.x_disp, B=scale_to_size)
normalize_2 = Division(A=visualize.z_disp, B=scale_to_size)
multiplication = Multiplication(A=vec.Vector, B=vector_size_2)
disp_vector = VectorXYZ(XComponent=normalize, YComponent=0, ZComponent=normalize_2)  # -> Vector, Length
scaled_vecs = VectorDisplay(Anchor=pt_6, Vector=multiplication)
equi_sized_vecs = VectorDisplay(Anchor=pt_6, Vector=disp_vector.Vector)

# ----
demesh = DeconstructMesh(Mesh=mesh)  # -> Vertices, Faces, Colours, Normals
cp = ClosestPoint(Point=pt_5, Cloud=demesh.Vertices)  # -> ClosestPoint, CPIndex, Distance
deletev = DeleteVertices(Mesh=mesh, Indices=cp.CPIndex, Shrink=True)
meshtoshell = MeshToShellKaramba3D(Mesh=deletev, LimitDistance_m=0.005)  # -> Element, Points, Info
wbnaked = WeaverbirdsNakedBoundary(MeshClosedPolylines=mesh)
pdecon = Deconstruct(Point=meshtoshell.Points)  # -> XComponent, YComponent, ZComponent
divide = DivideCurve(Curve=wbnaked, Count=300, Kinks=False)  # -> Points, Tangents, Parameters
sort = SortList(Keys=pdecon.ZComponent, ValuesA=meshtoshell.Points)  # -> Keys, ValuesA
Z = UnitZ(Factor=1)
equals = Equality(FirstNumber=sort.Keys, SecondNumber=0)  # -> Equality, Inequality
pdecon_2 = Deconstruct(Point=divide.Points)  # -> XComponent, YComponent, ZComponent
loads = LoadsKaramba3D(Vector=expr("-x", Z), LCase=0, mode="Gravity")
dispatch = Dispatch(List=sort.ValuesA, DispatchPattern=equals.Equality)  # -> ListA, ListB
sort_2 = SortList(Keys=pdecon_2.ZComponent, ValuesA=divide.Points)  # -> Keys, ValuesA
supp = SupportKaramba3D(PosInd=dispatch.ListA, menu=[buttons(on, on, on, on, on, on)])
equals_2 = Equality(FirstNumber=sort_2.Keys, SecondNumber=0)  # -> Equality, Inequality
dispatch_2 = Dispatch(List=sort_2.ValuesA, DispatchPattern=equals_2.Equality)  # -> ListA, ListB
pt_7 = Point(dispatch_2.ListB)
assemble = AssembleModelKaramba3D(Elem=meshtoshell.Element, Support=flatten(supp), Load=loads, LimitDistance_m=0.005)  # -> Model, Info, Mass_kg, CenterOfGravity
meshcp = MeshClosestPoint(Point=pt_7, Mesh=deletev)  # -> Point, Index, Parameter
analyze = AnalyzeKaramba3D(Model=assemble.Model)  # -> CalculatedModel, MaximumDisplacement_cm, ResultingForceOfGravity_kN, ElasticEnergy_kNm
shelllineresults = LineResultsOnShellsKaramba3D(
    AnalyzedModel=analyze.CalculatedModel,
    LayerPosition=0,
    ListOfSourcesOfPrincipalStressLinesLinesPoints=meshcp.Point,
    SegmentLength_m=1,
    DA_deg=5,
    mode="PrincStress")  # -> AnalyzedModel, Lines1, Lines2
preview_2 = CustomPreview(
    Geometry=shelllineresults.Lines1,
    Material={diffuse=RGB(220, 20, 60), emission=RGB(220, 20, 60), shine=0.5, specular=RGB(255, 255, 255), transparency=0})
preview_3 = CustomPreview(
    Geometry=shelllineresults.Lines2,
    Material={diffuse=RGB(65, 105, 225), emission=RGB(65, 105, 225), shine=0.5, specular=RGB(255, 255, 255), transparency=0})

preview_4 = CustomPreview(Geometry=deletev, Material=ColourSwatch(SwatchColor=RGBA(255, 255, 255, 59)))

shellvecresults = ResultVectorsOnShellsKaramba3D(AnalyzedModel=analyze.CalculatedModel, LayerPosition=0, mode="PrincStress")  # -> AnalyzedModel, Points, FirstPrincipalStressVector_kN_cm2, SecondPrincipalStressVector_kN_cm2, FirstPrincipalStressValue_kN_cm2, SecondPrincipalStressValue_kN_cm2

multiplication_2 = Multiplication(A=shellvecresults.FirstPrincipalStressVector_kN_cm2, B=Slider(10, range=0..10))
vdisex = VectorDisplayEx(Point=shellvecresults.Points, Vector=multiplication_2, Colour=RGB(164, 118, 207), Width=2)
