# Grasshopper definition window_in_wall_interactive_1_R6.ghx (Grasshopper 1.0.7)
# plug-ins: karambaGH, Weaverbird

number_slider = Slider(100, range=0..100)
crv = Curve(<curve referenced from the Rhino model>)
crv_2 = Curve(<curve referenced from the Rhino model>)
gateleft = Curve(<curve referenced from the Rhino model>)
gateright = Curve(<curve referenced from the Rhino model>)
gatebottom = Curve(<curve referenced from the Rhino model>)
number_slider_2 = Slider(2.4, range=1..3)
number_slider_3 = Slider(1.2, range=0..2)

reload = Button()
py = PythonScript(reload=reload)
# ---------- py: Python ----------
from compas_rhino.utilities.misc import get_tolerance
from compas_rhino.utilities.misc import unload_modules

from compas_ghpython import unload_modules

unload_modules("compas")
unload_modules("compas_fab")
unload_modules("ur_fabrication_control")
unload_modules("assembly_information_model")
unload_modules("am_information_model") 
unload_modules("window_in_wall")
# ---------- end py ----------
py_2 = PythonScript()  # -> HERE, DATA
# ---------- py_2: Python ----------
import os

HERE = os.path.dirname(ghdoc.Path)
DATA = os.path.abspath(os.path.join(HERE, "..", "data"))

#print(HERE)
#print(DATA)
# ---------- end py_2 ----------

list = ValueList({"circular", "persian", "interactive"}, selected="interactive")
toggle = BooleanToggle(True)
join = JoinCurves(Curves=[gateleft, gateright, gatebottom], Preserve=False)

width = Number(4.8)
height = Number(3.3)
elsize = Number(0.02)
create_wall = GhPythonScript(init=Button(), width=width, height=height, elsize=elsize)  # -> wall
# ---------- create_wall: Python ----------
from window_in_wall import Wall


# create wall
wall = Wall()


# construct COMPAS quad mesh from width and height
wall.create_quad_mesh_from_dimensions(width, height, elsize)
# ---------- end create_wall ----------

make_gate_analytical = GhPythonScript(wall=create_wall, make_gate=toggle, gate_type=list, gate_x=number_slider_2, gate_size=number_slider_3)  # -> out, wall
# ---------- make_gate_analytical: Python ----------
if make_gate:
    wall.make_gate(gate_size, gate_x, gate_type)
# ---------- end make_gate_analytical ----------
cluster = Cluster(int=number_slider, crv=crv, crv_2=gateleft)
cluster_2 = Cluster_2(int=number_slider, crv=crv_2, crv_2=gateright)
crv_3 = Curve(flatten(cluster))
make_gate_interactive = GhPythonScript(wall=create_wall, make_gate=toggle, gate_type=list, gate_x=number_slider_2, gate_size=number_slider_3, gate=join)  # -> out, wall; inputs gate: Curve
# ---------- make_gate_interactive: Python ----------
import math
import compas
import Rhino as rh
import ghpythonlib as gh
from compas.datastructures import Mesh


for vertex in wall.mesh.vertices():
    # get x and z coordinates from vertex
    x_val = wall.mesh.vertex_attribute(vertex, name='x')
    z_val = wall.mesh.vertex_attribute(vertex, name='z')

    # calculate distance
    gate_rel_x = gate_x-x_val
    gate_rel_z = z_val

    #in order to avoid division by zero. should be cleaned up ASAP
    if gate_rel_x==0:
        gate_rel_x=0.000000001

    #this boolean will be set to True if vertex lies inside the gate 
    in_gate_vertex = False

    #for each gate tpye, the a corresponding function is called to check
    # to check if vertex lies inside the gate
    if gate_type=="circular":
        if wall.in_gate_circular(gate_size, gate_rel_x,gate_rel_z):
            in_gate_vertex = True
    if gate_type=="persian":
        if wall.in_gate_persian(gate_size, gate_rel_x,gate_rel_z):
            in_gate_vertex = True
    if gate_type=="interactive":
        point = rh.Geometry.Point3d( wall.mesh.vertex_attribute(vertex, name='x'), 0, wall.mesh.vertex_attribute(vertex, name='z') )
        pointInGate = gh.components.PointInCurve(point,gate).relationship
        if pointInGate == 2: in_gate_vertex = True

    if in_gate_vertex:
        # store new vertex attribute with the distance to the gate center
        wall.mesh.vertex_attribute(vertex,"x_disp", value=-gate_rel_x)
        wall.mesh.vertex_attribute(vertex,"z_disp", value=gate_rel_z)
        #in_gate flag indicates that this vertex lies in the gate
        wall.mesh.vertex_attribute(vertex,"in_gate", value=True)
        wall.gate_points.append(vertex)
# ---------- end make_gate_interactive ----------
crv_4 = Curve(flatten(cluster_2))
displacement = GhPythonScript(wall=make_gate_interactive.wall, comp_displ=toggle)  # -> out, wall
# ---------- displacement: Python ----------
from compas.rpc import Proxy

if comp_displ:
    #wall_methods_numpy = Proxy('window_in_wall.wall_methods_numpy')
    wall_methods_pde = Proxy('window_in_wall.wall_methods_pde')
    #wall_methods_numpy.stop_server() #if changes need to be reloaded
    #wall_methods_numpy.start_server()
    
    # compute displacement
    #solX, solZ = wall_methods_numpy.compute_displacement(wall.mesh,wall.gate_points, wall.x_size, wall.z_size)
    solX = wall_methods_pde.compute_displacement_x(wall.mesh,wall.gate_points, wall.x_size, wall.z_size)
    solZ = wall_methods_pde.compute_displacement_z(wall.mesh,wall.gate_points, wall.x_size, wall.z_size)
    
    # update vertex attributes with displacement values
    for v, data in wall.mesh.vertices(data=True):        
        wall.mesh.vertex_attribute(v, "x_disp", value=solX[v]) #value=solX[n_from_ij(i,j, wall.z_size)]
        wall.mesh.vertex_attribute(v, "z_disp", value=solZ[v]) #value=solZ[n_from_ij(i,j, wall.z_size)]
    
    # displace the vertices (for preview only)
    #wall.displace_vertices()
    #solmat = np.reshape(solX, (-1, n))
# ---------- end displacement ----------

up_phase = Slider(0.12, range=0..3)
up_freq = Slider(1, range=1..3)
up_amp = Slider(0, range=0..0.1)
down_freq = Slider(2.4, range=1..3)
down_amp = Slider(0.1, range=0..0.1)
wave = GhPythonScript(
    wall=displacement.wall,
    wave=Toggle(True),
    up_amp=up_amp,
    up_freq=up_freq,
    up_phase=up_phase,
    down_amp=down_amp,
    down_freq=down_freq,
    down_phase=up_phase)  # -> out, wall; inputs wave: Boolean
# ---------- wave: Python ----------
if wave:
    #wall.undulate(amp, freq, phase)
    #wall.undulate(up_amp, up_freq, up_phase, down_amp, down_freq, down_phase)
    wall.undulate_with_displ(up_amp, up_freq, up_phase, down_amp, down_freq, down_phase)
    #wall.undulate_with_displ(amp, freq, phase)
# ---------- end wave ----------

# ---- group: vector field
vector_size = Slider(0.219, range=0..0.5)
minus_one = Number(-1)
eps = Number(1e-07)
pow = Power(A=vector_size, B=minus_one)
vector_size_2 = Slider(0.655, range=0..1)

# ----
visualize = GhPythonScript(wall=wave.wall)  # -> out, rhmesh, vertices, points, x_disp, z_disp
# ---------- visualize: Python ----------
from compas_ghpython.artists import MeshArtist

# Mesh Artist for visualization
artist = MeshArtist(wall.mesh)
#vertices = artist.draw_vertices()
#edges = artist.draw_edges()
#faces = artist.draw_faces()
#labels = {key: key for key in mesh.vertices()}

rhmesh = artist.draw()


# draw gate points
v = []
for vertex in wall.mesh.vertices():
    gp = wall.mesh.vertex_attribute(vertex, name='in_gate')
    if gp: v.append(vertex)

if len(v): vertices = artist.draw_vertices(vertices=v)

x_disp = []
z_disp = []
for vertex in wall.mesh.vertices():
    x_disp.append(wall.mesh.vertex_attribute(vertex, name='x_disp'))
    z_disp.append(wall.mesh.vertex_attribute(vertex, name='z_disp'))
    

p = []
for vertex in wall.mesh.vertices():
    if gp: v.append(vertex)

if len(v): points = artist.draw_vertices(vertices=p)
# ---------- end visualize ----------
pt = Point(visualize.vertices)
mesh = Mesh(visualize.rhmesh)
preview = CustomPreview(Geometry=pt, Material=ColourSwatch(SwatchColor=RGB(255, 184, 184)))

pt_2 = Point(visualize.points)

# ---- group: vector field (continued)
vec = VectorXYZ(XComponent=visualize.x_disp, YComponent=0, ZComponent=visualize.z_disp)  # -> Vector, Length
avoid_zero = Addition(A=vec.Length, B=eps)
scale_to_size = Multiplication(A=avoid_zero, B=pow)
normalize = Division(A=visualize.x_disp, B=scale_to_size)
normalize_2 = Division(A=visualize.z_disp, B=scale_to_size)
multiplication = Multiplication(A=vec.Vector, B=vector_size_2)
disp_vector = VectorXYZ(XComponent=normalize, YComponent=0, ZComponent=normalize_2)  # -> Vector, Length
scaled_vecs = VectorDisplay(Anchor=pt_2, Vector=multiplication)
equi_sized_vecs = VectorDisplay(Anchor=pt_2, Vector=disp_vector.Vector)

# ----
demesh = DeconstructMesh(Mesh=mesh)  # -> Vertices, Faces, Colours, Normals
cp = ClosestPoint(Point=pt, Cloud=demesh.Vertices)  # -> ClosestPoint, CPIndex, Distance
deletev = DeleteVertices(Mesh=mesh, Indices=cp.CPIndex, Shrink=True)
meshtoshell = MeshToShellKaramba3D(Mesh=deletev, LimitDistance_m=0.005)  # -> Element, Points, Info
wbnaked = WeaverbirdsNakedBoundary(MeshClosedPolylines=mesh)
pdecon = Deconstruct(Point=meshtoshell.Points)  # -> XComponent, YComponent, ZComponent
divide = DivideCurve(Curve=wbnaked, Count=300, Kinks=False)  # -> Points, Tangents, Parameters
sort = SortList(Keys=pdecon.ZComponent, ValuesA=meshtoshell.Points)  # -> Keys, ValuesA
Z = UnitZ(Factor=1)
equals = Equality(FirstNumber=sort.Keys, SecondNumber=0)  # -> Equality, Inequality
pdecon_2 = Deconstruct(Point=divide.Points)  # -> XComponent, YComponent, ZComponent
loads = LoadsKaramba3D(Vector=expr("-x", Z), LCase=0, mode="Gravity")
dispatch = Dispatch(List=sort.ValuesA, DispatchPattern=equals.Equality)  # -> ListA, ListB
sort_2 = SortList(Keys=pdecon_2.ZComponent, ValuesA=divide.Points)  # -> Keys, ValuesA
supp = SupportKaramba3D(PosInd=dispatch.ListA, menu=[buttons(on, on, on, on, on, on)])
equals_2 = Equality(FirstNumber=sort_2.Keys, SecondNumber=0)  # -> Equality, Inequality
dispatch_2 = Dispatch(List=sort_2.ValuesA, DispatchPattern=equals_2.Equality)  # -> ListA, ListB
pt_3 = Point(dispatch_2.ListB)
assemble = AssembleModelKaramba3D(Elem=meshtoshell.Element, Support=flatten(supp), Load=loads, LimitDistance_m=0.005)  # -> Model, Info, Mass_kg, CenterOfGravity
meshcp = MeshClosestPoint(Point=pt_3, Mesh=deletev)  # -> Point, Index, Parameter
analyze = AnalyzeKaramba3D(Model=assemble.Model)  # -> CalculatedModel, MaximumDisplacement_cm, ResultingForceOfGravity_kN, ElasticEnergy_kNm
shelllineresults = LineResultsOnShellsKaramba3D(
    AnalyzedModel=analyze.CalculatedModel,
    LayerPosition=0,
    ListOfSourcesOfPrincipalStressLinesLinesPoints=meshcp.Point,
    SegmentLength_m=1,
    DA_deg=5,
    mode="PrincStress")  # -> AnalyzedModel, Lines1, Lines2
preview_2 = CustomPreview(
    Geometry=shelllineresults.Lines1,
    Material={diffuse=RGB(220, 20, 60), emission=RGB(220, 20, 60), shine=0.5, specular=RGB(255, 255, 255), transparency=0})
preview_3 = CustomPreview(
    Geometry=shelllineresults.Lines2,
    Material={diffuse=RGB(65, 105, 225), emission=RGB(65, 105, 225), shine=0.5, specular=RGB(255, 255, 255), transparency=0})

preview_4 = CustomPreview(Geometry=deletev, Material=ColourSwatch(SwatchColor=RGBA(255, 255, 255, 59)))

shellvecresults = ResultVectorsOnShellsKaramba3D(AnalyzedModel=analyze.CalculatedModel, LayerPosition=0, mode="PrincStress")  # -> AnalyzedModel, Points, FirstPrincipalStressVector_kN_cm2, SecondPrincipalStressVector_kN_cm2, FirstPrincipalStressValue_kN_cm2, SecondPrincipalStressValue_kN_cm2

multiplication_2 = Multiplication(A=shellvecresults.FirstPrincipalStressVector_kN_cm2, B=Slider(10, range=0..10))
vdisex = VectorDisplayEx(Point=shellvecresults.Points, Vector=multiplication_2, Colour=RGB(164, 118, 207), Width=2)

# ==== cluster Cluster
crv = ClusterInput()
crv_2 = ClusterInput()
int = ClusterInput()
crv_3 = Curve(crv)
crv_4 = Curve(crv_2)
int_2 = Integer(int)
divide = DivideCurve(Curve=reparameterize(crv_4), Count=int_2, Kinks=False)  # -> Points, Tangents, Parameters
divide_2 = DivideCurve(Curve=reparameterize(crv_3), Count=int_2, Kinks=False)  # -> Points, Tangents, Parameters
pframe = PerpFrame(Curve=reparameterize(crv_3), Parameter=divide.Parameters)
pframe_2 = PerpFrame(Curve=reparameterize(crv_4), Parameter=divide_2.Parameters)
deplane = DeconstructPlane(Plane=pframe)  # -> graft(Origin), XAxis, YAxis, ZAxis
deplane_2 = DeconstructPlane(Plane=pframe_2)  # -> graft(Origin), XAxis, YAxis, ZAxis
merge = Merge(Data1=deplane.Origin, Data2=deplane_2.Origin)
intcrv_t = InterpolateT(Vertices=merge, TangentStart=expr("-x", graft(deplane.XAxis)), TangentEnd=graft(deplane_2.XAxis), KnotStyle=1)  # -> Curve, Length, Domain
C = ClusterOutput(intcrv_t.Curve)

# ==== cluster Cluster_2
crv = ClusterInput()
crv_2 = ClusterInput()
int = ClusterInput()
crv_3 = Curve(crv)
crv_4 = Curve(crv_2)
int_2 = Integer(int)
divide = DivideCurve(Curve=reparameterize(crv_4), Count=int_2, Kinks=False)  # -> Points, Tangents, Parameters
divide_2 = DivideCurve(Curve=reparameterize(crv_3), Count=int_2, Kinks=False)  # -> Points, Tangents, Parameters
pframe = PerpFrame(Curve=reparameterize(crv_3), Parameter=divide.Parameters)
pframe_2 = PerpFrame(Curve=reparameterize(crv_4), Parameter=divide_2.Parameters)
deplane = DeconstructPlane(Plane=pframe)  # -> graft(Origin), XAxis, YAxis, ZAxis
deplane_2 = DeconstructPlane(Plane=pframe_2)  # -> graft(Origin), XAxis, YAxis, ZAxis
merge = Merge(Data1=deplane.Origin, Data2=deplane_2.Origin)
intcrv_t = InterpolateT(Vertices=merge, TangentStart=graft(deplane.XAxis), TangentEnd=expr("-x", graft(deplane_2.XAxis)), KnotStyle=1)  # -> Curve, Length, Domain
C = ClusterOutput(intcrv_t.Curve)
